# Grasshopper definition 10_Graph.gh (Grasshopper 1.0.8)
# plug-ins: NGon_RH8

# ----
# Axis From Minimal Triangulaton
number_slider = Slider(100, range=0..100)
crv = Curve(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)
divide = DivideCurve(Curve=crv, Count=number_slider, Kinks=False)  # -> Points, Tangents, Parameters
pline = PolyLine(Vertices=divide.Points, Closed=invert(False))
delaunay = Delaunay(Polylines=pline)
facec = FaceCircles(Mesh=delaunay)  # -> Centers, Ratio
meshskeleton = MeshSkeleton(Mesh=delaunay, Points=facec.Centers, Smooth=Slider(43, range=0..100), Prune=Slider(0, range=0..5))  # -> Skeleton, _3ValenceLines, NakedPoints, AllEndPoints
crv_2 = Curve(meshskeleton.Skeleton)
display = CurvePreview(Curve=crv_2, Width=Slider(10, range=0..10))

crv_3 = Curve([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])

# ----
# 3D/2D Convex Hull
pt = Point([Point(26.5553141, -83.98322758, 0), Point(1.331621004, -127.2546015, 0), Point(-30.66478589, -67.84494997, -15.33362395), Point(-43.17328976, -119.560986, 0), Point(-13.44612556, -94.37091071, 52.45641757)])
convexhull = ConvexHull(Points=pt)  # -> Mesh, Polyline, Points, Index

# ----
# Color Mesh Edges
number_slider_2 = Slider(-1, range=-1..1)
# Tutorials: https://www.learn-visual-programming.com/
# 
# Support: petrasvestartas@gmail.com
# 
# Coffee or Beer : https://ko-fi.com/petrasvestartas
# Graph
brep = Brep(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)
hexdivide = HexDivide(
    Surface=brep,
    V=10,
    Parameter=0.25,
    Boundary=number_slider_2,
    Swap=True,
    Rebuild=9,
    Quadrangulate=False,
    Divisions=False,
    Explode=True)  # -> Mesh, DistA, DistB
top = GetPolylines(Mesh=hexdivide.Mesh)
display_2 = CurvePreview(Curve=top, Width=Slider(3, range=0..10), Colour=ColourSwatch(SwatchColor=RGB(0, 0, 0)))

top_2 = GetPolylines(Mesh=hexdivide.Mesh)
fromp = FromPolylines(Curves=top_2, Min_Triangulation=True)

coloring = Coloring(M=fromp, N=Slider(2, range=0..10), EF=True)  # -> Edges, ID
item = ListItem(List=coloring.Edges, Index=coloring.ID, Wrap=True)
tstat = TreeStatistics(Tree=coloring.ID)  # -> Paths, Length, Count
range = Range(Domain=Domain(0, 1), Steps=expr("x-1", tstat.Count))
gradient = Gradient(LowerLimit=0, UpperLimit=1, Parameter=range, stops=[0: RGB(255, 255, 255), 1: RGB(255, 128, 0)])
fromp_2 = FromPolylines(Curves=item, Min_Triangulation=True)
preview = CustomPreview(Geometry=fromp_2, Material=graft(gradient))

# ----
# BFS
number_slider_3 = Slider(-1, range=-1..1)
brep_2 = Brep(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)
hexdivide_2 = HexDivide(
    Surface=brep_2,
    V=10,
    Parameter=0.25,
    Boundary=number_slider_3,
    Swap=True,
    Rebuild=9,
    Quadrangulate=False,
    Divisions=False,
    Explode=True)  # -> Mesh, DistA, DistB

top_3 = GetPolylines(Mesh=hexdivide_2.Mesh)
fromp_3 = FromPolylines(Curves=top_3, Min_Triangulation=False)

bfs = BFS(Mesh=fromp_3, Start=Slider(7, range=0..10), Angle=0.14)  # -> Vertices, Edges, EdgeVec, Bad, Mesh, FaceVec

ngoncenters = NGonCenters(Mesh=fromp_3)  # -> Centers, Normals, Planes
item_2 = ListItem(List=ngoncenters.Centers, Index=bfs.Vertices, Wrap=True)
amp = Amplitude(Vector=bfs.FaceVec, Amplitude=Slider(9.18, range=0..10))  # -> graft(Vector)
vdis = VectorDisplay(Anchor=graft(item_2), Vector=amp)

edges = NGonEdges(Mesh=fromp_3)  # -> Edges, ID, NakedID, Normal, Naked, AllE
curvepoint = PointOnCurve(edges.AllE, parameter=0.5)
amp_2 = Amplitude(Vector=bfs.EdgeVec, Amplitude=Slider(2.31, range=0..10))  # -> graft(Vector)
vdis_2 = VectorDisplay(Anchor=graft(curvepoint), Vector=amp_2)

item_3 = ListItem(List=ngoncenters.Centers, Index=bfs.Edges, Wrap=True)
pline_2 = PolyLine(Vertices=item_3, Closed=False)

# ----
# Curve Meshing
crv_4 = Curve([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])
genes = GenePool(Decimals=2, Maximum=100, Minimum=0, Value=[35.3, 46.9, 21.1, 25.23, 28.2])

curveends = CurveEnds(Curves=crv_4, Tolerance=0.01)

meshcurve = MeshCurve(Curve=curveends, Radius=genes, Circles=crv_3, U=4, V=4, VDist=0)  # -> Mesh, Anchors0, Anchors1, Outlines, Nodes
area = Area(Geometry=meshcurve.Nodes)  # -> Area, Centroid
naked = NakedVertices(Mesh=meshcurve.Mesh)  # -> Vertices, Status
points = PointList(Points=area.Centroid, Size=Slider(10, range=0..10))
