# Grasshopper definition 11_ReciprocalPattern.gh (Grasshopper 1.0.8)
# plug-ins: NGon_RH8

# Tutorials: https://www.learn-visual-programming.com/
# 
# Support: petrasvestartas@gmail.com
# 
# Coffee or Beer : https://ko-fi.com/petrasvestartas
number_slider = Slider(25, range=0..90)
pt = ConstructPoint(XCoordinate=0, YCoordinate=0, ZCoordinate=Slider(-9.162, range=-10..20))
X = UnitX(Factor=1)
Z = UnitZ(Factor=Slider(7, range=0..20))
neg = Negative(Value=number_slider)
brep = Brep([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])
brep_2 = Brep(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)
rot3d = Rotate3D(Geometry=brep, Angle=degrees([number_slider, neg]), Center=pt, Axis=X)  # -> Geometry, Transform
move = Move(Geometry=brep_2, Motion=Z)  # -> Geometry, Transform
brep_3 = Brep(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)
brep_4 = Brep([move.Geometry, rot3d.Geometry])
sdiff = SolidDifference(BrepsA=brep_3, BrepsB=brep_4)
debrep = DeconstructBrep(Brep=sdiff)  # -> Faces, Edges, Vertices
item = ListItem(List=debrep.Faces, Index=0, Wrap=True)  # -> Item, Item1
md_slider = MDSlider(
    SliderMode=0,
    slider_value=Point(0.4967184067, 0.5032811165, 0.5),
    x_domain=Domain(0, 1),
    y_domain=Domain(0, 1),
    z_domain=Domain(0, 1))
debrep_2 = DeconstructBrep(Brep=item.Item1)  # -> Faces, Edges, Vertices
item_2 = ListItem(List=debrep_2.Edges, Index=0, Wrap=True)  # -> Item, Item1, Item2, Item3
iso = IsoCurve(Surface=debrep_2.Faces, UVPoint=md_slider)  # -> UIsocurve, VIsocurve
merge = Merge(Data1=flatten(item_2.Item), Data2=flatten(iso.UIsocurve), Data3=flatten(item_2.Item2))
crv = Curve(flatten(merge))
item_3 = ListItem(List=crv, Index=0, Wrap=True)  # -> Item, Item1, Item2
flip = FlipCurve(Curve=crv, Guide=item_3.Item)  # -> Curve, Flag
divide = DivideCurve(Curve=flip.Curve, Count=2, Kinks=False)  # -> Points, Tangents, Parameters
item_4 = ListItem(List=divide.Points, Index=0, Wrap=True)  # -> Item, Item1, Item2
arc = Arc3Pt(PointA=item_4.Item, PointB=item_4.Item1, PointC=item_4.Item2)  # -> flatten(Arc), Plane, Radius
reb = RebuildCurve(Curve=arc.Arc, Count=10, Tangents=False)
loft = Loft(Curves=reb, Options={Adjust=False, Closed=False, LoftEnds=0, LoftSimp=1, LoftType=0, Rebuild=10, Refit=0.01})
hexdivide = HexDivide(
    Surface=loft,
    U=Slider(10, range=0..20),
    V=Slider(3, range=0..10),
    Parameter=Slider(0.37, range=0..1),
    Boundary=0,
    Swap=True,
    Rebuild=-1,
    Quadrangulate=False,
    Divisions=True,
    Explode=False)  # -> Mesh, DistA, DistB
recipricalvolume = RecipricalVolume(
    Mesh=hexdivide.Mesh,
    Angle=Slider(0.22, range=-1..1),
    Scale=1.4,
    NormalType=True,
    Height=1,
    Offset=2,
    Thickness=1,
    RoofSurface=loft,
    W1=1,
    W2=1)  # -> CM, C0, C1, P, EP, I0, FP, CL, Structure
number_slider_2 = Slider(20, range=0..40)
scale = Scale(Geometry=recipricalvolume.CM, Center=Point(0, 0, 0), Factor=Slider(25, range=0..100))  # -> Geometry, Transform
ext = ExtendCurve(Curve=scale.Geometry, Type=0, Start=number_slider_2, End=number_slider_2)
midpt = CurveMiddle(Curve=ext)
pdecon = Deconstruct(Point=midpt)  # -> XComponent, YComponent, ZComponent
larger = LargerThan(FirstNumber=pdecon.ZComponent, SecondNumber=Slider(191, range=0..1000))  # -> LargerThan, OrEqualTo
cull = CullPattern(List=ext, CullPattern=larger.LargerThan)
line = Line(cull)
pipe = Pipe(Curve=line, Radius=Slider(8, range=0..10), Caps=0)
cap = CapHoles(Brep=pipe)
