# Grasshopper definition 12_MeshStatistics_Coloring.gh (Grasshopper 1.0.8)
# plug-ins: NGon_RH8

# ---- group: Mesh Statistics
mesh = Mesh(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)
# Tutorials: https://www.learn-visual-programming.com/
# 
# Support: petrasvestartas@gmail.com
# 
# Coffee or Beer : https://ko-fi.com/petrasvestartas
mesh_2 = Mesh(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)
tri = Triangulate(Mesh=mesh)  # -> Mesh, Count
dual = Dual(Mesh=tri.Mesh, Type=0)
meshstatistics = MeshStatistics(Mesh=mesh_2)  # -> NGons, Edges, Vertices
meshstatistics_2 = MeshStatistics(Mesh=dual)  # -> NGons, Edges, Vertices
panel = Panel([meshstatistics.NGons, meshstatistics.Edges, meshstatistics.Vertices])
panel_2 = Panel([meshstatistics_2.NGons, meshstatistics_2.Edges, meshstatistics_2.Vertices])

# ---- group: Color Mesh Faces
mesh_3 = Mesh(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)
ngoncenters = NGonCenters(Mesh=mesh_3)  # -> Centers, Normals, Planes
pt = Point(Point(-12.06665002, 4.604076675, 0))
dist = Distance(PointA=ngoncenters.Centers, PointB=pt)
bnd = Bounds(Numbers=dist)
remap = RemapNumbers(Value=dist, Source=bnd, Target=Domain(0, 1))  # -> Mapped, Clipped
gradient = Gradient(
    LowerLimit=0,
    UpperLimit=1,
    Parameter=remap.Mapped,
    stops=[0: RGB(255, 155, 0), 0.338: RGB(255, 255, 0), 0.691: RGB(173, 89, 254), 1: RGB(255, 0, 255)])
colormesh = ColorMesh(Mesh=mesh_3, Color=gradient)

mesh_4 = Mesh(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)
tri_2 = Triangulate(Mesh=mesh_4)  # -> Mesh, Count
dual_2 = Dual(Mesh=tri_2.Mesh, Type=0)
weld = WeldMesh(Mesh=dual_2, Radius=0.001, Align=False, Use_RTree=False)
ngoncenters_2 = NGonCenters(Mesh=weld)  # -> Centers, Normals, Planes
pt_2 = Point(Point(-12.06665002, 4.604076675, 0))
dist_2 = Distance(PointA=ngoncenters_2.Centers, PointB=pt_2)
bnd_2 = Bounds(Numbers=dist_2)
remap_2 = RemapNumbers(Value=dist_2, Source=bnd_2, Target=Domain(0, 1))  # -> Mapped, Clipped
gradient_2 = Gradient(
    LowerLimit=0,
    UpperLimit=1,
    Parameter=remap_2.Mapped,
    stops=[0: RGB(255, 155, 0), 0.338: RGB(255, 255, 0), 0.691: RGB(173, 89, 254), 1: RGB(255, 0, 255)])
colormesh_2 = ColorMesh(Mesh=weld, Color=gradient_2)
