# Grasshopper definition 1_CreateNgon.gh (Grasshopper 1.0.8)
# plug-ins: NGon_RH8

# ----
# Create NGon Mesh
# Mesh With Ngons from Polylines
crv = Curve([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])
crv_2 = Curve(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)
crv_3 = Curve(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)
# Tutorials: https://www.learn-visual-programming.com/
# 
# Support: petrasvestartas@gmail.com
# 
# Coffee or Beer : https://ko-fi.com/petrasvestartas
from_polylines = FromPolylines(Polylines=crv, Min_Triangulation=False)
merge = Merge(Data1=crv_2, Data2=crv_3)
fromph = FromPH(Polylines=merge)

# ----
# Mesh With Ngons from Breps
B = Brep(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)
from_brep = FromBrep(Brep=B, Weld=-1)  # -> Mesh, Polylines
mesh = Mesh(from_brep.Mesh)
clear = Clear(Mesh=mesh)

# ----
# Display Settings
swatch = ColourSwatch(SwatchColor=RGB(168, 168, 168))
mesh_2 = Mesh(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)
ngonpreview = NGonPreview(Mesh=mesh_2, Front=swatch, Back=ColourSwatch(SwatchColor=RGB(255, 144, 0)), LineColor=RGB(0, 0, 0))

# ----
# Mesh To Ngon
# Naked edge
# becomes
# Ngon boundary
mesh_3 = Mesh(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)
from_mesh = FromMesh(Mesh=mesh_3, ID=0, It=1000)  # -> Mesh, VertexID, Polylines

# ----
# Get Mesh Ngon Polylines
mesh_4 = Mesh(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)
getpolylines = GetPolylines(Mesh=mesh_4)
