# Grasshopper definition 2_SubdivideSurface.gh (Grasshopper 1.0.8)
# plug-ins: NGon_RH8

# ----
# Orient Brep Faces and Subdivide with Merge
# If only U parameter is given edges are divided by distance
brep = Brep([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])
brep_2 = Brep([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])
brep_3 = Brep([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])
brep_4 = Brep([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])
join = BrepJoin(Breps=brep_4)  # -> Breps, Closed
sortbrep = SortBrep(Brep=join.Breps)
hexdivide = HexDivide(
    Surface=sortbrep,
    U=Slider(1.23, range=0..2),
    Parameter=Slider(0.22, range=0..1),
    Boundary=0,
    Swap=True,
    Rebuild=-1,
    Quadrangulate=False,
    Divisions=True,
    Explode=False)  # -> Mesh, DistA, DistB
mesh = Mesh(hexdivide.Mesh)

# ----
# Quads
number_slider = Slider(28, range=10..100)
# Tutorials: https://www.learn-visual-programming.com/
# 
# Support: petrasvestartas@gmail.com
# 
# Coffee or Beer : https://ko-fi.com/petrasvestartas
# Subdivide Nurbs Surface
brep_5 = Brep(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)
quaddivide = QuadDivide(Surface=brep_5, U=Slider(28, range=10..100), V=number_slider, Divisions=False, Explode=True)

platonic = Platonic(I=Slider(0, range=0..3), R=Slider(87, range=0..100), P=PlaneXY(0, 0, 0), S=Slider(2, range=0..43))
dual = Dual(Mesh=platonic, Type=1)

# ----
# Hex
number_slider_2 = Slider(0, range=0..2)
number_slider_3 = Slider(34, range=10..100)
brep_6 = Brep(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)
hexdivide_2 = HexDivide(
    Surface=brep_6,
    U=Slider(23, range=10..100),
    V=Slider(6, range=-2..102),
    Parameter=Slider(0.4, range=0..1),
    Boundary=number_slider_2,
    Swap=Toggle(True),
    Rebuild=-2,
    Quadrangulate=False,
    Divisions=False,
    Explode=False)  # -> Mesh, DistA, DistB

# ----
# Diamonds
number_slider_4 = Slider(22, range=10..100)
brep_7 = Brep(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)
diamonddivide = DiamondDivide(
    Surface=brep_7,
    U=number_slider_4,
    V=Slider(42, range=10..100),
    Boundary=Toggle(False),
    Swap=Toggle(True),
    Flip=True,
    Divisions=False,
    Explode=True)

# ----
# Orient Brep Faces and Subdivide
# according to average brep edge length
brep_8 = Brep([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])
join_2 = BrepJoin(Breps=brep_8)  # -> Breps, Closed
sortbrep_2 = SortBrep(Brep=join_2.Breps)
quaddivide_2 = QuadDivide(Surface=sortbrep_2, U=Slider(0.8, range=0.1..11), Rebuild=-1, Divisions=True, Explode=False)

# ----
# Platonic Objects
number_slider_5 = Slider(1, range=-1..1)
pt = ConstructPoint(XCoordinate=Slider(0, range=-1..1), YCoordinate=Slider(0.62, range=-1..1), ZCoordinate=number_slider_5)
pt_2 = ConstructPoint(XCoordinate=Slider(1, range=-1..1), YCoordinate=Slider(-1, range=-1..1), ZCoordinate=Slider(1, range=-1..1))
pl = PlaneNormal(Origin=Point(0, 0, 0), ZAxis=[pt, pt_2])
planarf = PlanarF(Mesh=dual)  # -> Polylines, Lines
cutmesh = CutMesh(M=dual, P=pl)
boundary = BoundarySurfaces(Edges=planarf.Polylines)
fromp = FromPolylines(Curves=cutmesh, Min_Triangulation=True)

# ----
# Chebyshev
number_slider_6 = Slider(20, range=0..100)
brep_9 = Brep(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)
chebyshev = Chebyshev(Surface=brep_9, Length=Slider(5, range=0..100), Rotation=number_slider_6, Steps=100, Extend=True, Animate=False)  # -> Mesh, Points

# ----
# Merge seams
number_slider_7 = Slider(20, range=2..20)
join_3 = BrepJoin(Breps=[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])  # -> Breps, Closed
item = ListItem(List=flatten(join_3.Breps), Index=Slider(5, range=0..10), Wrap=True)

multiplication = Multiplication(A=number_slider_7, B=Slider(0.5, range=0..4))
round = Round(Number=multiplication)  # -> Nearest, Floor, Ceiling
mod = Modulus(A=round.Nearest, B=2)
addition = Addition(A=round.Nearest, B=mod)

hexdivide_3 = HexDivide(
    Surface=item,
    U=number_slider_7,
    V=addition,
    Parameter=Slider(0.5, range=0..1),
    Boundary=0,
    Swap=True,
    Rebuild=-1,
    Quadrangulate=False,
    Divisions=False,
    Explode=False)  # -> Mesh, DistA, DistB
mesh_2 = Mesh(hexdivide_3.Mesh)
