# Grasshopper definition 3_Transformations_Subdivision_With_Kangaroo2.gh (Grasshopper 1.0.8)
# plug-ins: Kangaroo2 Components, NGon_RH8

# ----
# Tutorials: https://www.learn-visual-programming.com/
# 
# Support: petrasvestartas@gmail.com
# 
# Coffee or Beer : https://ko-fi.com/petrasvestartas
mesh = Mesh([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])
mesh_2 = Mesh([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])
mesh_3 = Mesh([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])
tesselate = TriangleSubdivision(Mesh=mesh_3, N=Slider(3, range=0..20))
weld = WeldMesh(Mesh=mesh_3, Radius=0.001, Align=False, Use_RTree=True)
weld_2 = WeldMesh(Mesh=tesselate, Radius=0.001, Align=False, Use_RTree=True)
dual = Dual(Mesh=weld_2, Type=0)
demesh = DeconstructMesh(Mesh=weld)  # -> Vertices, Faces, Colours, Normals
top = GetPolylines(Mesh=dual)
curvecp = CurveCP(Points=demesh.Vertices, Curve=top, Tol=0.01)  # -> Points, ID
lng = ListLength(List=curvecp.Points)  # -> flatten(Length)
dispatch = Dispatch(List=top, DispatchPattern=lng)  # -> ListA, ListB
cp = ControlPoints(Curve=dispatch.ListA)  # -> Points, Weights, Knots
fromp = FromPolylines(Curves=dispatch.ListB, Min_Triangulation=True)
edgelengths = EdgeLengths(Mesh=fromp, LengthFactor=1, Strength=10)
anchor = Anchor(Point=cp.Points, Strength=10000)
vertexloads = VertexLoads(Mesh=fromp, Strength=Slider(0.83, range=0..1))
show = Show(G=fromp)
bouncysolver = BouncySolver(
    GoalObjects=[anchor, edgelengths, vertexloads, show],
    Reset=Button(),
    Threshold=1e-15,
    Tolerance=0.01,
    Damping=0.99,
    Iterations=10,
    On=True)  # -> I, V, O
item = ListItem(List=bouncysolver.O, Index=0, Wrap=True)
corners = Corners(Mesh=item, Angle=135)  # -> Corners, ID
simplify = Simplify(Mesh=item, Fixed=corners.Corners)
project = ProjectNGons(Mesh=simplify, Offset=0)
ngonpreview = NGonPreview(Mesh=simplify, LineColor=RGB(0, 0, 0))
