# Grasshopper definition 3_Transformations_With_Kangaroo2.gh (Grasshopper 1.0.7)
# plug-ins: NGon 2.1, OpenNest, Kangaroo2 Components

# ----
# Quad Patches
# Input Geometry:
number_slider = Slider(2.9, range=0.1..11)
brep = Brep([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])
join = BrepJoin(Breps=brep)  # -> Breps, Closed
sortbrep = SortBrep(Brep=join.Breps)
quaddivide = QuadDivide(Surface=sortbrep, U=number_slider, Rebuild=-1, Divisions=True, Explode=False)
mesh = Mesh(quaddivide)

# ----
# Triangulation
mesh_2 = Mesh(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)  # disabled
mesh_3 = Mesh(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)  # disabled
weld = WeldMesh(Mesh=flatten(mesh_2), Radius=0.001, Align=True, Use_RTree=True)  # disabled
explodemesh = ExplodeMesh(Mesh=weld, Explode=invert(False))  # disabled
demesh = DeconstructMesh(Mesh=explodemesh)  # -> Vertices, Faces, Colours, Normals; disabled
item = ListItem(List=demesh.Vertices, Index=0, Wrap=True)  # -> Item, Item1, Item2, Item3; disabled
srf4pt = _4PointSurface(CornerA=item.Item, CornerB=item.Item1, CornerC=item.Item2, CornerD=item.Item3)  # disabled
number_slider_2 = Slider(1.354, range=0..2)  # disabled
join_2 = BrepJoin(Breps=flatten(srf4pt))  # -> Breps, Closed; disabled
sortbrep_2 = SortBrep(Brep=join_2.Breps)  # disabled
number_slider_3 = Slider(1.8, range=0.9..2)  # disabled
quaddivide_2 = QuadDivide(Surface=sortbrep_2, U=number_slider_2, Rebuild=-1, Divisions=True, Explode=True)  # disabled
diagonal = DiagonalMesh(Mesh=quaddivide_2)  # disabled
crv = Curve([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])  # disabled
hexdivide = HexDivide(
    Surface=sortbrep_2,
    U=number_slider_3,
    Parameter=0.25,
    Boundary=0,
    Swap=True,
    Rebuild=-1,
    Quadrangulate=False,
    Divisions=True,
    Explode=True)  # -> Mesh, DistA, DistB; disabled
triangulate = Triangulate(Mesh=diagonal, Curves=crv)  # disabled
dual = Dual(Mesh=triangulate, Type=0)  # disabled
naked = NakedVertices(Mesh=hexdivide.Mesh)  # -> Vertices, Status; disabled

# ----
# Input Geometry:
brep_2 = Brep([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])  # disabled
brep_3 = Brep([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])  # disabled
brep_4 = Brep([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])  # disabled
# Hex Subdivision Patches
brep_5 = Brep([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])  # disabled
join_3 = BrepJoin(Breps=brep_5)  # -> Breps, Closed; disabled
number_slider_4 = Slider(0.22, range=0..1)  # disabled
number_slider_5 = Slider(2, range=0..2)  # disabled
sortbrep_3 = SortBrep(Brep=join_3.Breps)  # disabled
hexdivide_2 = HexDivide(
    Surface=sortbrep_3,
    U=number_slider_5,
    Parameter=number_slider_4,
    Boundary=0,
    Swap=True,
    Rebuild=-1,
    Quadrangulate=False,
    Divisions=True,
    Explode=False)  # -> Mesh, DistA, DistB; disabled
mesh_4 = Mesh(hexdivide_2.Mesh)  # disabled

brep_6 = Brep([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])  # disabled
brep_7 = Brep([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])  # disabled
brep_8 = Brep([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])  # disabled
# Book Spheres
brep_9 = Brep([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])  # disabled
brep_10 = Brep([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])  # disabled
brep_11 = Brep([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])  # disabled

# ---- group: Outline Curve:
# Hex Culling
crv_2 = Curve(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)

# ---- group: Cutout Curves:
crv_3 = Curve([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])

# ----
# Input Geometry:
number_slider_6 = Slider(2.4, range=0.1..11)  # disabled
brep_12 = Brep(brep_6)  # disabled
join_4 = BrepJoin(Breps=brep_12)  # -> Breps, Closed; disabled
sortbrep_4 = SortBrep(Brep=join_4.Breps)  # disabled
quaddivide_3 = QuadDivide(Surface=sortbrep_4, U=number_slider_6, Rebuild=-1, Divisions=True, Explode=False)  # disabled
clear = Clear(Mesh=quaddivide_3)  # disabled
tri = Triangulate(Mesh=clear)  # -> Mesh, Count; disabled
mesh_5 = Mesh(tri.Mesh)  # disabled

platonic = Platonic(I=Slider(0, range=0..3), R=Slider(87, range=0..100), P=PlaneXY(0, 0, 0), S=Slider(2, range=0..43))
dual_2 = Dual(Mesh=platonic, Type=1)

# ----
# Input Geometry:
number_slider_7 = Slider(1.09, range=1..1.25)
bbox = BoundingBox(Content=crv_2, Plane=PlaneXY(0, 0, 0), UnionBox=True)  # -> Box, Box_2
rdiff = RegionDifference(CurvesA=crv_2, CurvesB=crv_3)
area = Area(Geometry=bbox.Box)  # -> Area, Centroid
boundary = BoundarySurfaces(Edges=rdiff)
scale = Scale(Geometry=bbox.Box, Center=area.Centroid, Factor=number_slider_7)  # -> Geometry, Transform
rec = Rectangle(scale.Geometry)
boundary_2 = BoundarySurfaces(Edges=rec)
hexdivide_3 = HexDivide(
    Surface=boundary_2,
    U=Slider(51, range=0..100),
    V=Slider(30, range=0..100),
    Parameter=Slider(0.33, range=0..1),
    Boundary=0,
    Swap=True,
    Rebuild=-1,
    Quadrangulate=False,
    Divisions=True,
    Explode=False)  # -> Mesh, DistA, DistB
top = GetPolylines(Mesh=hexdivide_3.Mesh)
meshcrv = MeshCP(Curve=top, Mesh=boundary, Tol_2=0.01)  # -> Curve, ID
from_polylines = FromPolylines(Curves=meshcrv.Curve, Min_Triangulation=True)
weldmesh = WeldMesh(Mesh=flatten(from_polylines), Radius=0.001, Align=False, Use_RTree=False)

pt = ConstructPoint(XCoordinate=Slider(1, range=-1..1), YCoordinate=Slider(-1, range=-1..1), ZCoordinate=Slider(1, range=-1..1))

# ---- group: Lift Only Outer Edge
# Kangaroo Goals
demesh_2 = DeconstructMesh(Mesh=mesh)  # -> Vertices, Faces, Colours, Normals
meshedges = MeshEdges(Mesh=mesh)  # -> AllE, NakedE
crv_4 = Curve([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])
end = EndPoints(Curve=meshedges.NakedE)  # -> Start, End
curvecp = CurveCP(Points=[end.Start, end.End], Curve=crv_4, Tol=0.01)  # -> Points, ID
length_line = LengthLine(Line=flatten(meshedges.AllE), Strength=Slider(100, range=0..100))
anchor = Anchor(Point=curvecp.Points, Strength=10000)
sc = SphereCollide(Points=demesh_2.Vertices, Radius=Slider(5, range=0.02..12), Strength=1)
load = Load(Point=demesh_2.Vertices, ForceVector=Vector(0, 0, 1), Weighting=Slider(26.01, range=0..26.01))
show = Show(G=mesh)

# ----
pt_2 = ConstructPoint(XCoordinate=Slider(0, range=-1..1), YCoordinate=Slider(0.62, range=-1..1), ZCoordinate=Slider(1, range=-1..1))
pl = PlaneNormal(Origin=Point(0, 0, 0), ZAxis=pt_2)
cutmesh = CutMesh(M=dual_2, P=pl)
planarf = PlanarF(Mesh=dual_2)  # -> Polylines, Lines
boundary_3 = BoundarySurfaces(Edges=planarf.Polylines)
fromp = FromPolylines(Curves=cutmesh, Min_Triangulation=True)
dam = DataDam(DataA=fromp, BufferDelay=10000000, BufferMode=0)

meshedges_2 = MeshEdges(Mesh=mesh_5)  # -> AllE, NakedE; disabled
number_slider_8 = Slider(1, range=0..100)  # disabled
length_line_2 = LengthLine(Line=flatten(meshedges_2.AllE), Strength=number_slider_8)  # disabled

curvepoint = PointOnCurve(meshedges_2.AllE, parameter=0.5)  # disabled
crv_5 = Curve([<curve referenced from the Rhino model> x5])  # disabled
crv_6 = Curve(<curve referenced from the Rhino model>)  # disabled
curvecp_2 = CurveCP(Points=curvepoint, Curve=[crv_5, crv_6], Tol=0.01)  # -> Points, ID; disabled
number_slider_9 = Slider(0, range=0..100)  # disabled
item_2 = ListItem(List=meshedges_2.AllE, Index=curvecp_2.ID, Wrap=True)  # disabled
length_line_3 = LengthLine(Line=flatten(item_2), Strength=number_slider_9)  # disabled

number_slider_10 = Slider(10, range=0..100)  # disabled
from_mesh = FromMesh(Mesh=mesh_5, ID=0, It=1000)  # -> Mesh, VertexID, Polylines; disabled
smoothpline = SmoothPolyline(Polyline=from_mesh.Polylines, Strength=1, Times=number_slider_10)  # disabled
cp = ControlPoints(Curve=from_mesh.Polylines)  # -> Points, Weights, Knots; disabled
cp_2 = ControlPoints(Curve=smoothpline)  # -> Points, Weights, Knots; disabled
anchor_2 = Anchor(Point=cp.Points, Target=cp_2.Points, Strength=10000)  # disabled

# ----
# Kangaroo Goals
demesh_3 = DeconstructMesh(Mesh=mesh_5)  # -> Vertices, Faces, Colours, Normals; disabled
number_slider_11 = Slider(0.48, range=0..26.01)  # disabled
load_2 = Load(Point=demesh_3.Vertices, ForceVector=Vector(0, 0, 1), Weighting=number_slider_11)  # disabled
show_2 = Show(G=mesh_5)  # disabled

# ----
# Kangaroo Solver
button = Button()
entwine = Entwine(Branch00=show, Branch01=sc, Branch02=load, Branch03=length_line, Branch04=anchor, FlattenInputs=True)
solver = Solver(GoalObjects=entwine, Reset=button, Threshold=1e-15, Tolerance=0.01, On=Toggle(True))  # -> I, V, O
bang = ExplodeTree(Data=solver.O)  # -> Branch0, Branch1, Branch2, Branch3, Branch4, Branch5

# ----
# Kangaroo Goals:
meshedges_3 = MeshEdges(Mesh=weldmesh)  # -> AllE, NakedE
demesh_4 = DeconstructMesh(Mesh=weldmesh)  # -> Vertices, Faces, Colours, Normals
show_3 = Show(G=weldmesh)

crv_7 = Curve(<curve referenced from the Rhino model>)
crv_8 = Curve([<curve referenced from the Rhino model> x3])
crv_9 = Curve(graft([crv_8, crv_7]))
offset = PolylineOffset(Curve=crv_9, Distance=Slider(20, range=0..20), Divisions=Slider(1, range=0..1))  # -> C, H
naked_2 = NakedVertices(Mesh=weldmesh)  # -> Vertices, Status
curvecp_3 = CurveCP(Points=naked_2.Vertices, Curve=offset.C, Tol=0.01)  # -> Points, ID
crv_cp = CurveClosestPoint(Point=curvecp_3.Points, Curve=crv_9)  # -> Point, Parameter, Distance
anchor_3 = Anchor(Point=curvecp_3.Points, Target=crv_cp.Point, Strength=10000)  # -> flatten(A)

# ---- group: Orient from 3d to 2d
# Add Sharp Type
top_2 = GetPolylines(Mesh=dam)
fromp_2 = FromPolylines(Curves=graft(top_2), Min_Triangulation=False)  # -> flatten(Mesh)
naked_3 = NakedVertices(Mesh=fromp_2)  # -> Vertices, Status
item_3 = ListItem(List=naked_3.Vertices, Index=0, Wrap=True)  # -> flatten(Item)
number_slider_12 = Slider(17, range=0..100)
unroll = Unroll(MeshOrBrep=simplify(graft(fromp_2)), Points=simplify(graft(item_3)))  # -> flatten(Brep), Curves, flatten(Points), TextDotsLocation, TextDots
partition = PartitionList(List=unroll.Points, Size=number_slider_12)
partition_2 = PartitionList(List=unroll.Brep, Size=number_slider_12)
pack = PackObjects(Geo=partition_2, Plane=partition, X=Slider(7, range=0..100), Y=Slider(35, range=0..100), Tolerabce=0)  # -> Geo, Transformation
number_slider_13 = Slider(5, range=0..40)
edges = BrepEdges(Brep=pack.Geo)  # -> Naked, Interior, NonManifold
len = Length(Curve=edges.Naked)
join_5 = JoinCurves(Curves=edges.Naked, Preserve=False)
division = Division(A=len, B=Slider(2.7, range=0..4))
round = Round(Number=division)  # -> Nearest, Floor, Ceiling
panel = Panel("""0
-1""")
divide = DivideCurve(Curve=edges.Naked, Count=round.Floor, Kinks=False)  # -> Points, Tangents, Parameters
offset_2 = PolylineOffset(Curve=join_5, Distance=Slider(1, range=0..1), Divisions=0)  # -> C, H
cull_i = CullIndex(List=divide.Points, Indices=panel, Wrap=True)
boundary_4 = BoundarySurfaces(Edges=offset_2.C)
pt_3 = Point(cull_i)

# ----
# Output
mesh_6 = Mesh(bang.Branch0)
triangulate_2 = Triangulate(Mesh=mesh_6)
dual_3 = Dual(Mesh=triangulate_2, Type=0)

# ----
# Kangaroo Solver
button_2 = Button()  # disabled
toggle = BooleanToggle(False)  # disabled
entwine_2 = Entwine(Branch00=show_2, Branch01=load_2, Branch02=length_line_2, Branch03=anchor_2, Branch04=length_line_3, FlattenInputs=True)  # disabled
solver_2 = Solver(GoalObjects=entwine_2, Reset=button_2, Threshold=1e-15, Tolerance=0.01, On=toggle)  # -> I, V, O; disabled

len_2 = Length(Curve=meshedges_3.AllE)
multiplication = Multiplication(A=len_2, B=Slider(0.5, range=0.01..1))
length_line_4 = LengthLine(Line=meshedges_3.AllE, Length=multiplication, Strength=Slider(10.341, range=1..100))

len_3 = Length(Curve=meshedges_3.NakedE)
multiplication_2 = Multiplication(A=len_3, B=Slider(0.4, range=0.01..1))
length_line_5 = LengthLine(Line=meshedges_3.NakedE, Length=multiplication_2, Strength=Slider(310.41, range=1..1000))

Z = UnitZ(Factor=Slider(32.64, range=0.1..100))
load_3 = Load(Point=demesh_4.Vertices, ForceVector=Z)

hingepoints = HingePoints(Mesh=weldmesh)  # -> _1, _2, _3, _4
hinge = Hinge(
    FoldStart=hingepoints._1,
    FoldEnd=hingepoints._2,
    Tip1=hingepoints._3,
    Tip2=hingepoints._4,
    RestAngle=Slider(0, range=0..100),
    Strength=Slider(1.429, range=0..10))  # -> flatten(Hinge)

# ----
# Cut Large Polygons
number_slider_14 = Slider(7, range=0..10)
split3 = Split3(Mesh=dual_3, Size=number_slider_14, Iteration=Slider(10, range=0..80), Smooth=5)
fromp_3 = FromPolylines(Curves=split3, Min_Triangulation=True)

# ----
# Output Dual
bang_2 = ExplodeTree(Data=solver_2.O)  # -> Branch0, Branch1, Branch2, Branch3, Branch4, Branch5; disabled
mesh_7 = Mesh(bang_2.Branch0)  # disabled
dual_4 = Dual(Mesh=mesh_7, Type=0)  # disabled
crv_10 = Curve(bang_2.Branch4)  # disabled

# ----
# Kangaroo Solver:
entwine_3 = Entwine(
    Branch00=show_3,
    Branch01=anchor_3,
    Branch02=hinge,
    Branch03=length_line_4,
    Branch04=length_line_5,
    Branch05=load_3,
    FlattenInputs=True)
solver_3 = Solver(GoalObjects=entwine_3, Reset=Button(), Threshold=1e-15, Tolerance=0.01, On=Toggle(True))  # -> I, V, O
bang_3 = ExplodeTree(Data=solver_3.O)  # -> Branch0, Branch1, Branch2, Branch3, Branch4, Branch5
mesh_8 = Mesh(bang_3.Branch0)

# ----
# Book Examples
crv_11 = Curve([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])  # disabled
number_slider_15 = Slider(50, range=0..100)  # disabled
bbox_2 = BoundingBox(Content=crv_11, Plane=PlaneXY(0, 0, 0), UnionBox=True)  # -> Box, Box_2; disabled
crv_12 = Curve(crv_11)  # disabled
rec_2 = Rectangle(bbox_2.Box)  # disabled
boundary_5 = BoundarySurfaces(Edges=rec_2)  # disabled
quaddivide_4 = QuadDivide(Surface=boundary_5, U=number_slider_15, V=number_slider_15, Rebuild=-1, Divisions=True, Explode=True)  # disabled
triangulate_3 = Triangulate(Mesh=quaddivide_4, Curves=crv_12)  # disabled
facesincurves = FacesInCurves(Mesh=triangulate_3, Curves=crv_12)  # disabled
button_3 = Button()  # disabled
toggle_2 = BooleanToggle(False)  # disabled

number_slider_16 = Slider(1, range=0..1)  # disabled
naked_4 = NakedVertices(Mesh=facesincurves)  # -> Vertices, Status; disabled
crv_cp_2 = CurveClosestPoint(Point=naked_4.Vertices, Curve=graft(crv_12))  # -> Point, Parameter, Distance; disabled
smaller = SmallerThan(FirstNumber=crv_cp_2.Distance, SecondNumber=number_slider_16)  # -> SmallerThan, OrEqualTo; disabled
cull = CullPattern(List=naked_4.Vertices, CullPattern=smaller.SmallerThan)  # disabled

number_slider_17 = Slider(0.4, range=0..1)  # disabled
number_slider_18 = Slider(54, range=0..100)  # disabled
meshedges_4 = MeshEdges(Mesh=facesincurves)  # -> AllE, NakedE; disabled
oncurve = OnCurve(Points=cull, Curve=graft(crv_12), Strength=500)  # disabled
pressure = Pressure(M=facesincurves, Strength=number_slider_17)  # disabled
equallength = EqualLength(Line=meshedges_4.AllE, Strength=10)  # disabled
length_line_6 = LengthLine(Line=meshedges_4.AllE, Length=0, Strength=1)  # disabled
smooth = Smooth(M=facesincurves, Strength=number_slider_18)  # disabled
show_4 = Show(G=facesincurves)  # disabled

solver_4 = Solver(
    GoalObjects=[show_4, oncurve, equallength, length_line_6, pressure, smooth],
    Reset=button_3,
    Threshold=1e-15,
    Tolerance=0.01,
    On=toggle_2)  # -> I, V, O; disabled
item_4 = ListItem(List=solver_4.O, Index=0, Wrap=True)  # disabled

# ---- group: Lift Only Outer Edge
# Kangaroo Goals
medges = MeshEdges(Mesh=mesh_4)  # -> NakedEdges, InteriorEdges, NonManifoldEdges; disabled
crv_13 = Curve([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])  # disabled
number_slider_19 = Slider(0.28, range=0..1)  # disabled
number_slider_20 = Slider(11, range=0..100)  # disabled
number_slider_21 = Slider(100, range=0..100)  # disabled
number_slider_22 = Slider(0.03, range=0.01..1)  # disabled
edges_2 = NGonEdges(Mesh=mesh_4)  # -> AllE, NakedE; disabled
face_edges = NGonFaceEdges(Mesh=mesh_4, TextSize=10, EdgeScale=0.75, Display_Edge_Faces=False, Display_Edges=False, Display_Faces=False)  # -> Edges, ID, FID; disabled
length_line_7 = LengthLine(Line=flatten(edges_2.AllE), Strength=number_slider_22)  # disabled
length_line_8 = LengthLine(Line=flatten(face_edges.Edges), Strength=number_slider_20)  # disabled
length_line_9 = LengthLine(Line=flatten(medges.InteriorEdges), Strength=number_slider_21)  # disabled
show_5 = Show(G=mesh_4)  # disabled

# ----
end_2 = EndPoints(Curve=medges.NakedEdges)  # -> Start, End; disabled
curvecp_4 = CurveCP(Points=[end_2.Start, end_2.End], Curve=crv_13, Tol=0.01)  # -> Points, ID; disabled

# ---- group: Lift Only Outer Edge (continued)
anchor_4 = Anchor(Point=curvecp_4.Points, Strength=10000)  # disabled
load_4 = Load(Point=[end_2.Start, end_2.End], ForceVector=Vector(0, 0, 1), Weighting=number_slider_19)  # disabled

# ----
# Kangaroo Solver
entwine_4 = Entwine(Branch00=show_5, Branch02=length_line_7, Branch03=length_line_8, Branch04=load_4, Branch05=anchor_4, FlattenInputs=True)  # disabled
button_4 = Button()  # disabled
toggle_3 = BooleanToggle(True)  # disabled
solver_5 = Solver(GoalObjects=entwine_4, Reset=button_4, Threshold=1e-15, Tolerance=0.01, On=toggle_3)  # -> I, V, O; disabled
bang_4 = ExplodeTree(Data=solver_5.O)  # -> Branch0, Branch1, Branch2, Branch3, Branch4, Branch5; disabled

# ----
# Output
mesh_9 = Mesh(bang_4.Branch0)  # disabled
top_3 = GetPolylines(Mesh=mesh_9)  # disabled
fromp_4 = FromPolylines(Curves=top_3, Min_Triangulation=True)  # disabled

# ---- group: delete middle points
corners = Corners(Mesh=fromp_4, Angle=135)  # -> Corners, ID; disabled
simplify = Simplify(Mesh=fromp_4, Fixed=corners.Corners)  # disabled

# ----
# Cut Large Polygons
number_slider_23 = Slider(5, range=0..80)  # disabled
number_slider_24 = Slider(10, range=0..100)  # disabled
number_slider_25 = Slider(7, range=0..10)  # disabled
clear_2 = Clear(Mesh=simplify)  # disabled
split3_2 = Split3(Mesh=simplify, Size=number_slider_25, Iteration=number_slider_23, Smooth=number_slider_24)  # disabled
fromp_5 = FromPolylines(Curves=split3_2, Min_Triangulation=False)  # disabled
planar = PlanarFaces(Mesh=fromp_5)  # -> Polylines, Lines; disabled
boundary_6 = BoundarySurfaces(Edges=graft(planar.Polylines))  # disabled
