# Grasshopper definition 4_1_Planarize.gh (Grasshopper 1.0.8)
# plug-ins: NGon_RH8

# Tutorials: https://www.learn-visual-programming.com/
# 
# Support: petrasvestartas@gmail.com
# 
# Coffee or Beer : https://ko-fi.com/petrasvestartas
brep = Brep(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)
hexdivide = HexDivide(
    Surface=brep,
    U=Slider(10, range=0..100),
    V=Slider(10, range=0..100),
    Parameter=Slider(0.5, range=0..1),
    Boundary=0,
    Swap=True,
    Rebuild=-1,
    Quadrangulate=False,
    Divisions=True,
    Explode=False)  # -> Mesh, DistA, DistB
weld = WeldMesh(Mesh=hexdivide.Mesh, Radius=0.001, Align=False, Use_RTree=True)
planar = PlanarFaces(Mesh=weld)  # -> Polylines, Lines
fromp = FromPolylines(Curves=planar.Polylines, Min_Triangulation=True)
crv = Curve(planar.Polylines)
crv_2 = Curve([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])
cutmesh = CutMesh(M=fromp, P=crv_2)
fromp_2 = FromPolylines(Curves=cutmesh, Min_Triangulation=True)
weld_2 = WeldMesh(Mesh=fromp_2, Radius=0.001, Align=True, Use_RTree=True)
unify = UnifyWindings(Mesh=weld_2)
meshflap = MeshFlap(Mesh=unify, Dist=Slider(0.251, range=0..1), Flip=Slider(0.369, range=0..1), Normals=Slider(0.307, range=0..1))  # -> Mesh, Curves, AddPolylines

brep_2 = Brep(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)
hexdivide_2 = HexDivide(
    Surface=brep_2,
    U=Slider(20, range=0..20),
    V=Slider(10, range=0..10),
    Parameter=0.25,
    Boundary=0,
    Swap=True,
    Rebuild=9,
    Quadrangulate=False,
    Divisions=False,
    Explode=True)  # -> Mesh, DistA, DistB
number_slider = Slider(2, range=0..2)
top = GetPolylines(Mesh=hexdivide_2.Mesh)

# ---- group: Use min triangulation
fromp_3 = FromPolylines(Curves=top, Min_Triangulation=False)

# ---- group: Keep Track of merged extruded mesh and offset mesh
offsetmesh = OffsetMesh(Mesh=fromp_3, Dist=expr("-1", number_slider), Solid=False)
extrude_edges = ExtrudeEdges(Mesh=fromp_3, Dist=number_slider, Cap=False, Merge=invert(False), BothSides=False)
mjoin = MeshJoin(Meshes=[fromp_3, offsetmesh])

# ----
planarize2 = Planarize2(
    Mesh=extrude_edges,
    Tangential=0.0001,
    Iterations=Slider(1000, range=0..1000),
    StaticSolver=invert(False),
    Run=invert(False),
    Reset=False)
panel = Panel(mjoin)
panel_2 = Panel(planarize2)

# ---- group: Check if planar
getpolylines = GetPolylines(Mesh=planarize2)
boundary = BoundarySurfaces(Edges=getpolylines)

# ---- group: Adjust vertex positions
matchmesh = AdjustMeshVertices(MeshA=mjoin, MeshB=planarize2)

# ----
projectpairs = ProjectPairs(Mesh=matchmesh, Scale=Slider(3, range=0..3))  # -> Mesh, Plines

crv_3 = Curve(projectpairs.Plines)
top_2 = GetPolylines(Mesh=projectpairs.Mesh)

# ---- group: Display
weldmesh = WeldMesh(Mesh=projectpairs.Mesh, Radius=Slider(-3, range=-10..-3), Align=False, Use_RTree=False)
