# Grasshopper definition 4_2_PlanarizeJoints.gh (Grasshopper 1.0.8)
# plug-ins: NGon_RH8

# Tutorials: https://www.learn-visual-programming.com/
# 
# Support: petrasvestartas@gmail.com
# 
# Coffee or Beer : https://ko-fi.com/petrasvestartas
brep = Brep(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)
hexdivide = HexDivide(
    Surface=brep,
    U=Slider(10, range=0..100),
    V=Slider(10, range=0..100),
    Parameter=Slider(0.5, range=0..1),
    Boundary=0,
    Swap=True,
    Rebuild=-1,
    Quadrangulate=False,
    Divisions=True,
    Explode=False)  # -> Mesh, DistA, DistB
weld = WeldMesh(Mesh=hexdivide.Mesh, Radius=0.001, Align=False, Use_RTree=True)
planar = PlanarFaces(Mesh=weld)  # -> Polylines, Lines
fromp = FromPolylines(Curves=planar.Polylines, Min_Triangulation=True)
crv = Curve([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])
cutmesh = CutMesh(M=fromp, P=crv)
fromp_2 = FromPolylines(Curves=cutmesh, Min_Triangulation=True)
weld_2 = WeldMesh(Mesh=fromp_2, Radius=0.001, Align=True, Use_RTree=True)

# ---- group: Finger Joints
unify = UnifyWindings(Mesh=weld_2)
corners = Corners(Mesh=unify, Angle=135)  # -> Corners, ID
simplify = Simplify(Mesh=unify, Fixed=corners.Corners)
offsetplanar = OffsetPlanar(Mesh=simplify, Dist=Slider(1, range=0..10))
flip = FlipMatrix(Data=offsetplanar)
miter = Miter(M=simplify, A=Slider(0.31624, range=0..1), B=Slider(0.325, range=0..1), S=Slider(0.205, range=0..1), P=flip)  # -> Mesh, Curves, AddPolylines

# ---- group: Preview Loft
flip_2 = FlipMatrix(Data=miter.AddPolylines)
dam = DataDam(DataA=flip_2, BufferDelay=10000000, BufferMode=0)
display = CurvePreview(Curve=flip_2)
item = ListItem(List=dam, Index=0, Wrap=True)  # -> Item, Item1
loft = LoftPolylines(Curve0=item.Item, Curve1=item.Item1, Fast=invert(True))
ngonpreview = NGonPreview(Mesh=loft, LineColor=RGB(0, 0, 0))

# ---- group: Planarize Extrusion
brep_2 = Brep(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)
hexdivide_2 = HexDivide(
    Surface=brep_2,
    U=Slider(20, range=0..20),
    V=Slider(10, range=0..10),
    Parameter=0.25,
    Boundary=0,
    Swap=True,
    Rebuild=9,
    Quadrangulate=False,
    Divisions=False,
    Explode=True)  # -> Mesh, DistA, DistB
weld_3 = WeldMesh(Mesh=hexdivide_2.Mesh, Radius=0.1, Align=False, Use_RTree=True)
unify_2 = UnifyWindings(Mesh=weld_3)
number_slider = Slider(8, range=0..210)
weld_4 = WeldMesh(Mesh=unify_2, Radius=0.1, Align=False, Use_RTree=True)

# ---- group: Planarize Extrusion / Keep Track of merged extruded mesh and offset mesh
offsetmesh = OffsetMesh(Mesh=weld_4, Dist=expr("-x", number_slider), Solid=False)
extrude_edges = ExtrudeEdges(Mesh=weld_4, Dist=number_slider, Cap=False, Merge=invert(False), BothSides=False)
mjoin = MeshJoin(Meshes=[weld_4, offsetmesh])

# ---- group: Planarize Extrusion (continued)
planarize2 = Planarize2(
    Mesh=extrude_edges,
    Tangential=0.0001,
    Iterations=Slider(1000, range=0..1000),
    StaticSolver=invert(False),
    Run=invert(False),
    Reset=False)
panel = Panel(mjoin)
disjoint = DisjointMesh(Mesh=mjoin)
panel_2 = Panel(planarize2)
item_2 = ListItem(List=disjoint, Index=0, Wrap=True)

# ---- group: Planarize Extrusion / Check if planar
getpolylines = GetPolylines(Mesh=planarize2)
boundary = BoundarySurfaces(Edges=getpolylines)

# ---- group: Planarize Extrusion / Adjust vertex positions
matchmesh = AdjustMeshVertices(MeshA=mjoin, MeshB=planarize2)

# ---- group: Planarize Extrusion (continued)
projectpairs = ProjectPairs(Mesh=matchmesh, Scale=Slider(1, range=0..1))  # -> Mesh, Plines

# ---- group: Finger Joints
flip_3 = FlipMatrix(Data=projectpairs.Plines)
miter_2 = Miter(M=item_2, A=Slider(0.8109, range=0..1), B=Slider(1.496, range=0..2), S=Slider(1.4, range=0..5), P=flip_3)  # -> Mesh, Curves, AddPolylines
flip_4 = FlipMatrix(Data=miter_2.AddPolylines)
crv_2 = Curve(miter_2.AddPolylines)
dam_2 = DataDam(DataA=flip_4, BufferDelay=10000000, BufferMode=0)
display_2 = CurvePreview(Curve=flip_4)
item_3 = ListItem(List=dam_2, Index=0, Wrap=True)  # -> Item, Item1
loft_2 = LoftPolylines(Curve0=item_3.Item, Curve1=item_3.Item1, Fast=invert(True))
ngonpreview_2 = NGonPreview(Mesh=loft_2, LineColor=RGB(0, 0, 0))
