# Grasshopper definition 4_Planarize.gh (Grasshopper 1.0.8)
# plug-ins: NGon_RH8

# ----
# Planarize NGons in a Mesh
toggle = BooleanToggle(True)
# Planarize NGons in a Mesh
button = Button()
mesh = Mesh(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)
# Set Rhino Tolerance to 0.01.
mesh_2 = Mesh(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)
mesh_3 = Mesh(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)
planarize2 = Planarize2(Mesh=mesh_3, Tangential=0, Iterations=Slider(10, range=0..2000), StaticSolver=toggle, Run=Toggle(True), Reset=button)
getpolylines = GetPolylines(Mesh=planarize2)
boundary = BoundarySurfaces(Edges=getpolylines)

mesh_4 = Mesh(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)  # disabled
number_slider = Slider(700, range=0..1000)  # disabled
getpolylines_2 = GetPolylines(Mesh=mesh_4)  # disabled
from_polylines = FromPolylines(Polylines=getpolylines_2, Min_Triangulation=False)  # disabled
planarize = Planarize(Mesh=from_polylines, Tolerance=0, Iterations=number_slider)  # -> Mesh, P, P_2; disabled
getpolylines_3 = GetPolylines(Mesh=planarize.Mesh)  # disabled
boundary_2 = BoundarySurfaces(Edges=getpolylines_3)  # disabled

# ----
# Project NGons To Average Plane
number_slider_2 = Slider(0, range=0..3)
mesh_5 = Mesh(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)
project = ProjectNGons(Mesh=mesh_5, Offset=number_slider_2)
boundary_3 = BoundarySurfaces(Edges=project)

number_slider_3 = Slider(700, range=0..11100)  # disabled
crv = Curve([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])  # disabled
from_polylines_2 = FromPolylines(Polylines=crv, Min_Triangulation=False)  # disabled
planarize_2 = Planarize(Mesh=from_polylines_2, Tolerance=0, Iterations=number_slider_3)  # -> Mesh, P, P_2; disabled
getpolylines_4 = GetPolylines(Mesh=planarize_2.Mesh)  # disabled
boundary_4 = BoundarySurfaces(Edges=getpolylines_4)  # disabled

# ----
# Project Two Mesh and Get Boxes
mesh_6 = Mesh(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)
getpolylines_5 = GetPolylines(Mesh=mesh_6)
from_polylines_3 = FromPolylines(Polylines=getpolylines_5, Min_Triangulation=False)
offsetmesh = OffsetMesh(Mesh=from_polylines_3, Dist=Slider(1.53, range=0..3), Solid=False)
mjoin = MeshJoin(Meshes=flatten([from_polylines_3, offsetmesh]))
weldmesh = WeldMesh(Mesh=mjoin, Radius=0.001, Align=False, Use_RTree=False)
projectpairs = ProjectPairs(Mesh=weldmesh, Scale=Slider(1, range=0..1))  # -> Mesh, Plines
weldmesh_2 = WeldMesh(Mesh=projectpairs.Mesh, Radius=-2, Align=False, Use_RTree=False)

panel = Panel("0.5")

brep_hyperboloid = Brep(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)
number_slider_4 = Slider(24, range=2..30)
brep_cylinder = Brep(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)
brep_loft = Brep(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)
brep_donut = Brep(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)
brep_flatshell = Brep(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)
brep_hypar = Brep(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)
# Tutorials: https://www.learn-visual-programming.com/
# 
# Support: petrasvestartas@gmail.com
# 
# Coffee or Beer : https://ko-fi.com/petrasvestartas
# Planarization
brep_hyperboloid_2 = Brep(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)
brep_sphere = Brep(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)
brep_hyperboloid_3 = Brep(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)
brep_quadsphere = Brep(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)
bbox = BoundingBox(Content=brep_donut, Plane=PlaneXY(0, 0, 0))  # -> Box, Box_2
area = Area(Geometry=bbox.Box)  # -> Area, Centroid
orient = Orient(Geometry=brep_donut, Source=area.Centroid, Target=PlaneXY(0, 0, 0))  # -> Geometry, Transform

multiplication = Multiplication(A=number_slider_4, B=Slider(0.4, range=0..4))
round = Round(Number=multiplication)  # -> Nearest, Floor, Ceiling
mod = Modulus(A=round.Nearest, B=2)
addition = Addition(A=round.Nearest, B=mod)

hexdivide = HexDivide(
    Surface=orient.Geometry,
    U=number_slider_4,
    V=addition,
    Parameter=Slider(0.47, range=0..1),
    Boundary=0,
    Swap=True,
    Rebuild=-1,
    Quadrangulate=False,
    Divisions=True,
    Explode=False)  # -> Mesh, DistA, DistB

corners = Corners(Mesh=hexdivide.Mesh, Angle=135)  # -> Corners, ID
simplify = Simplify(Mesh=hexdivide.Mesh, Fixed=corners.Corners)

# ---- group: Planarize
# Parts of shell where it becomes flat
# Mesh.FromClosedPolyline return not ordered
# naked points, all function will fail that use thise
# method
unify = UnifyWindings(Mesh=simplify)
top = GetPolylines(Mesh=unify)
planarf = PlanarF(Mesh=unify)  # -> Polylines, Lines

# ----
display = CurvePreview(Curve=planarf.Lines, Width=5, Colour=RGB(0, 0, 0))
boundary_5 = BoundarySurfaces(Edges=planarf.Polylines)
fromp = FromPolylines(Curves=graft(planarf.Polylines), Min_Triangulation=False)  # -> flatten(Mesh)

# ---- group: Offset
number_slider_5 = Slider(0.2, range=0..1)  # disabled
weld = WeldMesh(Mesh=fromp, Radius=number_slider_5, Align=False, Use_RTree=False)  # disabled
offsetmesh_2 = OffsetMesh(Mesh=weld, Dist=1)  # disabled
naked = NakedVertices(Mesh=weld)  # -> Vertices, Status; disabled
loft = LoftPolylines(Curve0=offsetmesh_2, Fast=invert(True))  # disabled
display_2 = CurvePreview(Curve=offsetmesh_2, Width=3)  # disabled
