# Grasshopper definition 5_Vertex.gh (Grasshopper 1.0.8)
# plug-ins: NGon_RH8

# ----
# NGons Edges around Ngon Vertices
mesh = Mesh(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)
vedge_ngons = NGonsEdgesAroundVertices(Mesh=mesh)  # -> Line, Index
vertices = NGonVertices(Mesh=mesh)  # -> graft(Vertices), ID, Naked, V, E0, E1
scale = Scale(Geometry=vedge_ngons.Line, Center=vertices.Vertices, Factor=0.4)  # -> Geometry, Transform
preview = CustomPreview(
    Geometry=scale.Geometry,
    Material={diffuse=RGB(255, 0, 0), emission=RGB(66, 48, 66), shine=0.5, specular=RGB(255, 255, 255), transparency=0})
preview_2 = CustomPreview(
    Geometry=vertices.Vertices,
    Material={diffuse=RGB(255, 0, 0), emission=RGB(66, 48, 66), shine=0.5, specular=RGB(255, 255, 255), transparency=0})

# ----
# NGons around Ngon Vertices
mesh_2 = Mesh(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)
weldmesh = WeldMesh(Mesh=mesh_2, Radius=0.001, Align=False, Use_RTree=False)
vertices_2 = NGonVertices(Mesh=weldmesh)  # -> graft(Vertices), ID, Naked, V, E0, E1
getpolylines = GetPolylines(Mesh=weldmesh)
ngoncenters = NGonCenters(Mesh=weldmesh)  # -> Centers, Normals, Planes
vertex_ngons = NGonsAroundVertices(Mesh=weldmesh, Naked=False)  # -> Index, Naked
item = ListItem(List=ngoncenters.Centers, Index=vertex_ngons.Index, Wrap=True)
ln = Line(StartPoint=vertices_2.Vertices, EndPoint=item)
scale_2 = Scale(Geometry=ln, Center=vertices_2.Vertices, Factor=0.7)  # -> Geometry, Transform
preview_3 = CustomPreview(
    Geometry=vertices_2.Vertices,
    Material={diffuse=RGB(255, 0, 0), emission=RGB(66, 48, 66), shine=0.5, specular=RGB(255, 255, 255), transparency=0})
preview_4 = CustomPreview(
    Geometry=scale_2.Geometry,
    Material={diffuse=RGB(255, 0, 0), emission=RGB(66, 48, 66), shine=0.5, specular=RGB(255, 255, 255), transparency=0})

# ----
# Ngon Vertices
mesh_3 = Mesh(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)
ngfacevertices = NGonFaceVertices(Mesh=mesh_3)  # -> Vertices, ID, TopoID
pline = PolyLine(Vertices=ngfacevertices.Vertices, Closed=invert(False))
avr = Average(Input=ngfacevertices.Vertices)
scale_3 = Scale(Geometry=pline, Center=avr, Factor=0.5)  # -> Geometry, Transform

# ----
# All Ngon Vertices (Naked/Clothed)
mesh_4 = Mesh(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)
# Tutorials: https://www.learn-visual-programming.com/
# 
# Support: petrasvestartas@gmail.com
# 
# Coffee or Beer : https://ko-fi.com/petrasvestartas
# Vertex
vertices_3 = NGonVertices(Mesh=mesh_4)  # -> Vertices, ID, Naked, V, E0, E1
dispatch = Dispatch(List=vertices_3.Vertices, DispatchPattern=vertices_3.Naked)  # -> ListA, ListB
preview_5 = CustomPreview(
    Geometry=dispatch.ListA,
    Material={diffuse=RGB(255, 0, 0), emission=RGB(66, 48, 66), shine=0.5, specular=RGB(255, 255, 255), transparency=0})

# ----
# NGons Vertices around Ngon Vertices (sorted)
mesh_5 = Mesh(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)
vertices_4 = NGonVertices(Mesh=mesh_5)  # -> Vertices, Vertices_2, ID, NID
