# Grasshopper definition 6_Edge.gh (Grasshopper 1.0.8)
# plug-ins: NGon_RH8

# ----
# Ngons Connected To Ngon Edges
mesh = Mesh(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)
getpolylines = GetPolylines(Mesh=mesh)
fromp = FromPolylines(Curves=getpolylines, Min_Triangulation=True)
number_slider = Slider(34, range=0..100)
edgengon = NGonsConnectedToNGonEdge(Mesh=fromp, Naked=False)  # -> ID, ID_2, DihedralAngle, DihedralAngleLocation
edges = NGonEdges(Mesh=fromp)  # -> Edges, ID, Naked, Normal, Naked_2, AllE
getpolylines_2 = GetPolylines(Mesh=fromp)
item = ListItem(List=edges.Edges, Index=number_slider, Wrap=True)
item_2 = ListItem(List=getpolylines_2, Index=edgengon.ID, Wrap=True)
preview = CustomPreview(
    Geometry=item,
    Material={diffuse=RGB(255, 0, 0), emission=RGB(66, 48, 66), shine=0.5, specular=RGB(255, 255, 255), transparency=0})
end = EndPoints(Curve=item)  # -> Start, End
branch = TreeBranch(Tree=simplify(item_2), Path=number_slider, MaintainPaths=True)

# ----
# Edges In Ngons
mesh_2 = Mesh(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)
unify = UnifyWindings(Mesh=mesh_2)
face_edges = NGonFaceEdges(
    Mesh=unify,
    TextSize=Slider(0.56, range=0..1),
    EdgeScale=0.75,
    Display_Edge_Faces=False,
    Display_Edges=True,
    Display_Faces=False)  # -> Edges, ID, FID

# ----
# Scale NGons Outlines by Pairs
number_slider_2 = Slider(0.2, range=0..1)
data = Data(Tree({0}: [4, 1], {1}: [5, 2], {2}: [6, 3], {3}: [0, 4], {4}: [1, 5], {5}: [2, 6]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))
mesh_3 = Mesh(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)
sedge = ScaleNGonFaceEdgesByNGonPairs(Mesh=mesh_3, NGonFacePair=data, Scale=number_slider_2)  # -> Edges, ID, Flag, Edges_2, Polylines
join = JoinCurves(Curves=sedge.Edges_2, Preserve=False)
preview_2 = CustomPreview(
    Geometry=sedge.Edges,
    Material={diffuse=RGB(255, 0, 0), emission=RGB(66, 48, 66), shine=0.5, specular=RGB(255, 255, 255), transparency=0})
from_polylines = FromPolylines(Polylines=flatten([sedge.Polylines, join]), Min_Triangulation=False)

# ----
# All NGon Edges
mesh_4 = Mesh(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)
# Tutorials: https://www.learn-visual-programming.com/
# 
# Support: petrasvestartas@gmail.com
# 
# Coffee or Beer : https://ko-fi.com/petrasvestartas
# Edge
edges_2 = NGonEdges(Mesh=mesh_4)  # -> Edges, ID, Naked, Normal, Naked_2, AllE

# ----
# Find Connected Edges of a Pair NGons
mesh_5 = Mesh(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)
data_2 = Data(Tree({0}: [4, 1], {1}: [5, 2], {2}: [6, 3], {3}: [0, 4], {4}: [1, 5], {5}: [2, 6]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))
edgebyfp = NGonFaceEdgesByNGonPairs(Mesh=mesh_5, NGonFacePair=data_2)  # -> Edges, ID, Flag
preview_3 = CustomPreview(
    Geometry=edgebyfp.Edges,
    Material={diffuse=RGB(255, 0, 0), emission=RGB(66, 48, 66), shine=0.5, specular=RGB(255, 255, 255), transparency=0})

# ----
# Angle Between Mesh Faces, Including Concave/Convex
number_slider_3 = Slider(0, range=0..100)
crv = Curve(reverse([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]))
mesh_6 = Mesh(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)
jitter = Jitter(List=crv, Jitter=number_slider_3, Seed=2)  # -> Values, Indices
top = GetPolylines(Mesh=mesh_6)
fromp_2 = FromPolylines(Curves=jitter.Values, Min_Triangulation=False)
edgengon_2 = NGonsConnectedToNGonEdge(Mesh=fromp_2, Naked=False)  # -> EF, EFPair, DihedralAngle, DihedralAngleLocation
ngoncenters = NGonCenters(Mesh=fromp_2)  # -> Centers, Normals, Planes
multiplication = Multiplication(A=ngoncenters.Normals, B=Slider(5, range=0..100))
vdis = VectorDisplay(Anchor=ngoncenters.Centers, Vector=multiplication)
