# Grasshopper definition 7_EdgeFaceAdjacency.gh (Grasshopper 1.0.8)
# plug-ins: Pufferfish, NGon_RH8

# ---- group: Cell
# Tutorials: https://www.learn-visual-programming.com/
# 
# Support: petrasvestartas@gmail.com
# 
# Coffee or Beer : https://ko-fi.com/petrasvestartas
number_slider = Slider(9, range=0..100)
number_slider_2 = Slider(10, range=0..10)
box = CenterBox(Base=PlaneXY(0, 0, 0), X=number_slider_2, Y=number_slider_2, Z=number_slider_2)
pop3d = Populate3D(Region=box, Count=number_slider, Seed=Slider(45, range=0..100))
vcell = VoronoiCell(Point=Point(0, 0, 0), Neighbours=pop3d, Box=box)

# ----
from_brep = FromBrep(Brep=vcell, Weld=-1)  # -> Mesh, Polylines
edges = NGonEdges(Mesh=from_brep.Mesh)  # -> Edges, ID, NakedID, Normal, Naked, AllE
ngoncenters = NGonCenters(Mesh=from_brep.Mesh)  # -> Centers, Normals, Planes
edgengon = NGonsConnectedToNGonEdge(Mesh=from_brep.Mesh, Naked=False)  # -> ID, ID_2, DihedralAngle, DihedralAngleLocation
vertices = NGonVertices(Mesh=from_brep.Mesh)  # -> graft(Vertices), Vertices_2, ID, NID
item = ListItem(List=ngoncenters.Normals, Index=edgengon.ID, Wrap=True)
end = EndPoints(Curve=edges.Edges)  # -> Start, End
midpt = CurveMiddle(Curve=edges.Edges)
ma = MassAddition(Input=item)  # -> Result, PartialResults
move2pt = MoveToPoint(PointA=Point(0, 0, 1))  # -> Moved, Vector, Transform
vec2pt = Vector2Pt(PointA=end.Start, PointB=midpt, Unitize=False)  # -> Vector, Length

vec2pt_2 = Vector2Pt(PointA=vertices.Vertices, PointB=vertices.Vertices_2, Unitize=False)  # -> Vector, Length
shift = ShiftList(List=vec2pt_2.Vector, Shift=1, Wrap=True)
shift_2 = ShiftList(List=vec2pt_2.Vector, Shift=-1, Wrap=True)
pl = PlaneNormal(Origin=vertices.Vertices, ZAxis=vec2pt_2.Vector)
subtraction = Subtraction(A=shift, B=shift_2)
align = AlignPlane(Plane=pl, Direction=subtraction)  # -> Plane, Angle
prot = RotatePlane(Plane=align.Plane, Angle=graft(degrees(Slider(0, range=0..90))))

vec2pt_3 = Vector2Pt(PointA=end.End, PointB=midpt, Unitize=False)  # -> Vector, Length

unit = UnitVector(Vector=vec2pt_2.Vector)
multiplication = Multiplication(A=unit, B=Slider(1.68, range=0..10))
addition = Addition(A=vertices.Vertices, B=multiplication)
pline = PolyLine(Vertices=addition, Closed=invert(False))
display = CurvePreview(Curve=pline)

pl_2 = PlaneNormal(Origin=end.Start, ZAxis=vec2pt.Vector)  # -> graft(Plane)
pl_3 = PlaneNormal(Origin=end.End, ZAxis=vec2pt_3.Vector)  # -> graft(Plane)

# ---- group: Pyamid
rectangle = Rectangle(Plane=PlaneXY(0, 0, 0), XSize=Domain(-0.2, 0.2), YSize=Domain(-0.5, 0.5), Radius=0)  # -> Rectangle, Length
extr = ExtrudePoint(Base=rectangle.Rectangle, Point=Point(0, 0, 1))
cap = CapHoles(Brep=extr)

# ----
pln = Plane([pl_2, pl_3])
align_2 = AlignPlane(Plane=pln, Direction=simplify(ma.Result))  # -> Plane, Angle

# ---- group: Pyamid
rectangle_2 = Rectangle(Plane=PlaneXY(0, 0, 0), XSize=Domain(-0.2, 0.2), YSize=Domain(-0.5, 0.5), Radius=0)  # -> Rectangle, Length
extr_2 = ExtrudePoint(Base=rectangle_2.Rectangle, Point=Point(0, 0, 1))
cap_2 = CapHoles(Brep=extr_2)

# ----
prot_2 = RotatePlane(Plane=align_2.Plane, Angle=graft(degrees(Slider(90, range=0..90))))
orient = Orient(Geometry=cap, Source=PlaneXY(0, 0, 0), Target=prot_2)  # -> Geometry, Transform
preview = CustomPreview(
    Geometry=orient.Geometry,
    Material={diffuse=RGB(153, 153, 153), emission=RGB(46, 46, 46), shine=0.5, specular=RGB(255, 255, 255), transparency=0})
orient_2 = Orient(Geometry=cap_2, Source=PlaneXY(0, 0, 0), Target=prot)  # -> Geometry, Transform
preview_2 = CustomPreview(
    Geometry=orient_2.Geometry,
    Material={diffuse=RGB(153, 153, 153), emission=RGB(46, 46, 46), shine=0.5, specular=RGB(255, 255, 255), transparency=0})
