# Grasshopper definition 7_Face.gh (Grasshopper 1.0.8)
# plug-ins: NGon_RH8

# ----
# NGons Connected To NGons
mesh = Mesh(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)
weldmesh = WeldMesh(Mesh=mesh, Radius=0.001, Align=False, Use_RTree=False)
getpolylines = GetPolylines(Mesh=weldmesh)
ngontongons = NGonToNGons(Mesh=weldmesh)  # -> AdjNgons, V, E0, E1
number_slider = Slider(19, range=0..50)
branch = TreeBranch(Tree=simplify(ngontongons.AdjNgons), Path=number_slider, MaintainPaths=True)
item = ListItem(List=getpolylines, Index=number_slider, Wrap=True)
item_2 = ListItem(List=getpolylines, Index=branch, Wrap=True)
from_polylines = FromPolylines(Polylines=item, Min_Triangulation=False)
from_polylines_2 = FromPolylines(Polylines=item_2, Min_Triangulation=False)
preview = CustomPreview(
    Geometry=from_polylines,
    Material={diffuse=RGB(255, 0, 0), emission=RGB(66, 48, 66), shine=0.5, specular=RGB(255, 255, 255), transparency=0})

# ----
# Mesh Faces in NGons
mesh_2 = Mesh(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)
ngonfaces = NGonFaces(Mesh=mesh_2)  # -> F, I

# ----
# Face
# NGons Centers/Normals/Planes
mesh_3 = Mesh(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)

weldmesh_2 = WeldMesh(Mesh=mesh_3, Radius=0.001, Align=False, Use_RTree=False)

# ----
# Tutorials: https://www.learn-visual-programming.com/
# 
# Support: petrasvestartas@gmail.com
# 
# Coffee or Beer : https://ko-fi.com/petrasvestartas
ngoncenters = NGonCenters(Mesh=weldmesh_2)  # -> Centers, Normals, Planes
