# Grasshopper definition 8_1_Utilities_BoundaryFirstFlattening.gh (Grasshopper 1.0.8)
# plug-ins: NGon_RH8

# ----
# If you are searching for MAC version: https://github.com/petrasvestartas/boundary_first_flattening_rhino
# This was a custom development project.
mesh = Mesh(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)
boundaryfirstflatenning = BoundaryFirstFlatenning(Mesh=mesh, MapToSphere=False)  # -> Mesh3D, Mesh2D
xy = XYPlane(Origin=Point(0, 0, 0))
from_mesh = FromMesh(Mesh=boundaryfirstflatenning.Mesh2D, ID=0, It=1000)  # -> Mesh, VertexID, Polylines
rotate = Rotate(Geometry=xy, Angle=degrees(Slider(123.44, range=0..360)), Plane=PlaneXY(0, 0, 0))  # -> Geometry, Transform
from_mesh_2 = FromMesh(Mesh=boundaryfirstflatenning.Mesh3D, ID=0, It=1000)  # -> Mesh, VertexID, Polylines
bbox = BoundingBox(Content=from_mesh.Mesh, Plane=rotate.Geometry)  # -> Box, Box_2
# Tutorials: https://www.learn-visual-programming.com/
# 
# Support: petrasvestartas@gmail.com
# 
# Coffee or Beer : https://ko-fi.com/petrasvestartas
ngonpreview = NGonPreview(Mesh=boundaryfirstflatenning.Mesh2D, LineColor=RGB(0, 0, 0))
number_slider = Slider(23, range=0..100)
edges = BrepEdges(Brep=bbox.Box)  # -> Naked, Interior, NonManifold
item = ListItem(List=edges.Naked, Index=0, Wrap=True)  # -> Item, Item1, Item2
display = CurvePreview(Curve=from_mesh_2.Polylines)
divide = DivideCurve(Curve=item.Item, Count=number_slider, Kinks=False)  # -> Points, Tangents, Parameters
divide_2 = DivideCurve(Curve=item.Item2, Count=number_slider, Kinks=False)  # -> reverse(Points), Tangents, Parameters
ln = Line(StartPoint=divide.Points, EndPoint=divide_2.Points)
divide_3 = DivideCurve(Curve=ln, Count=Slider(100, range=0..100), Kinks=False)  # -> Points, Tangents, Parameters
pline = PolyLine(Vertices=divide_3.Points, Closed=False)
ccx = CurveCurve(CurveA=from_mesh.Polylines, CurveB=pline)  # -> Points, ParamsA, ParamsB
shatter = Shatter(Curve=pline, Parameters=ccx.ParamsB)
curvepoint = PointOnCurve(shatter, parameter=0.5)
incurve = PointInCurve(Point=curvepoint, Curve=from_mesh.Polylines)  # -> Relationship, Point
cull = CullPattern(List=shatter, CullPattern=incurve.Relationship)
mapmesh = MapMesh(Curves=cull, Mesh0=boundaryfirstflatenning.Mesh2D, Mesh1=boundaryfirstflatenning.Mesh3D)  # -> simplify(Curve)
preview = CustomPreview(Geometry=mapmesh, Material=ColourSwatch(SwatchColor=RGB(110, 110, 110)))
number_slider_2 = Slider(100, range=0..100)
relitem = RelativeItem(Tree=mapmesh, Offset="{1}", WrapPaths=False, WrapItems=False)  # -> ItemA, ItemB
divide_4 = DivideCurve(Curve=relitem.ItemA, Count=number_slider_2, Kinks=False)  # -> Points, Tangents, Parameters
divide_5 = DivideCurve(Curve=relitem.ItemB, Count=number_slider_2, Kinks=False)  # -> Points, Tangents, Parameters
pline_2 = PolyLine(Vertices=divide_5.Points, Closed=False)
pline_3 = PolyLine(Vertices=divide_4.Points, Closed=False)
loft = Loft(
    Curves=[pline_3, pline_2],
    Options={Adjust=False, Closed=False, LoftEnds=0, LoftSimp=1, LoftType=0, Rebuild=10, Refit=0.01})

mesh_2 = Mesh(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)
boundaryfirstflatenning_2 = BoundaryFirstFlatenning(Mesh=mesh_2, MapToSphere=False)  # -> Mesh3D, Mesh2D
xy_2 = XYPlane(Origin=Point(0, 0, 0))
from_mesh_3 = FromMesh(Mesh=boundaryfirstflatenning_2.Mesh3D, ID=0, It=1000)  # -> Mesh, VertexID, Polylines
from_mesh_4 = FromMesh(Mesh=boundaryfirstflatenning_2.Mesh2D, ID=0, It=1000)  # -> Mesh, VertexID, Polylines
rotate_2 = Rotate(Geometry=xy_2, Angle=degrees(Slider(123.44, range=0..360)), Plane=PlaneXY(0, 0, 0))  # -> Geometry, Transform
crv = Curve(from_mesh_3.Polylines)
bbox_2 = BoundingBox(Content=from_mesh_4.Mesh, Plane=rotate_2.Geometry)  # -> Box, Box_2
number_slider_3 = Slider(30, range=0..100)
edges_2 = BrepEdges(Brep=bbox_2.Box)  # -> reverse(Naked), Interior, NonManifold
item_2 = ListItem(List=edges_2.Naked, Index=0, Wrap=True)  # -> Item, Item1, Item2
divide_6 = DivideCurve(Curve=item_2.Item, Count=number_slider_3, Kinks=False)  # -> Points, Tangents, Parameters
divide_7 = DivideCurve(Curve=item_2.Item2, Count=number_slider_3, Kinks=False)  # -> reverse(Points), Tangents, Parameters
ln_2 = Line(StartPoint=divide_6.Points, EndPoint=divide_7.Points)
divide_8 = DivideCurve(Curve=ln_2, Count=Slider(100, range=0..100), Kinks=False)  # -> Points, Tangents, Parameters
pline_4 = PolyLine(Vertices=divide_8.Points, Closed=False)
ccx_2 = CurveCurve(CurveA=from_mesh_4.Polylines, CurveB=pline_4)  # -> Points, ParamsA, ParamsB
shatter_2 = Shatter(Curve=pline_4, Parameters=ccx_2.ParamsB)
curvepoint_2 = PointOnCurve(shatter_2, parameter=0.5)
incurve_2 = PointInCurve(Point=curvepoint_2, Curve=from_mesh_4.Polylines)  # -> Relationship, Point
cull_2 = CullPattern(List=shatter_2, CullPattern=incurve_2.Relationship)
mapmesh_2 = MapMesh(Curves=cull_2, Mesh0=boundaryfirstflatenning_2.Mesh2D, Mesh1=boundaryfirstflatenning_2.Mesh3D)
preview_2 = CustomPreview(Geometry=mapmesh_2, Material=ColourSwatch(SwatchColor=RGB(0, 0, 0)))
