# Grasshopper definition 8_Utilities.gh (Grasshopper 1.0.8)
# plug-ins: NGon_RH8

# ----
# Remesh
number_slider = Slider(5, range=0..10)
mesh = Mesh(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)
remesh = Remesh(Mesh=mesh, FixEdges=True, EdgeLength=number_slider, Iterations=Slider(210, range=0..210), Project=invert(True))
dual = Dual(Mesh=remesh, Type=0)

# ---- group: Values for display change
dom = ConstructDomain(DomainStart=Slider(0.120323, range=0.120323..0.19), DomainEnd=Slider(0.175983, range=0.120323..0.19))

# ----
# Voxels + Preview Mesh Edges by angle
number_slider_2 = Slider(0.230613, range=0.220323..1.220324)
brep = Brep(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)
pop3d = Populate3D(Region=brep, Count=100, Seed=1)
voxels = Voxels(Points=pop3d, Scale=number_slider_2)  # -> Mesh, Points
mesh_2 = Mesh(voxels.Mesh)
previewedges = PreviewEdges(Mesh=mesh_2, Tolerance=0.49)

# ----
# Simplify Mesh
pt = Point([Point(508.9401079, -16.99452241, 0), Point(543.9920666, -30.37004045, 0), Point(508.5804465, -49.27791855, 0)])
crv = Curve([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])
from_polylines = FromPolylines(Curves=crv, Min_Triangulation=False)
simplify = Simplify(Mesh=from_polylines, Fixed=pt)

# ----
# Boundary First Flatenning
mesh_3 = Mesh(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)
boundaryfirstflatenning = BoundaryFirstFlatenning(Mesh=mesh_3, MapToSphere=False)  # -> Mesh3D, Mesh2D

# ----
# Project Naked Edge to Curves
surface = Surface(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)
mesh_4 = Mesh(surface)
bbox = BoundingBox(Content=mesh_4, Plane=PlaneXY(0, 0, 0))  # -> Box, Box_2
area = Area(Geometry=bbox.Box)  # -> Area, Centroid
scale = Scale(Geometry=bbox.Box, Center=area.Centroid, Factor=1.25)  # -> Geometry, Transform
rec = Rectangle(scale.Geometry)
hexdivide = HexDivide(
    Surface=rec,
    U=Slider(37, range=0..100),
    V=Slider(26, range=0..100),
    Parameter=Slider(0.33, range=0..1),
    Boundary=0,
    Swap=True,
    Rebuild=-1,
    Quadrangulate=False,
    Divisions=True,
    Explode=False)  # -> Mesh, DistA, DistB
top = GetPolylines(Mesh=hexdivide.Mesh)
meshcrv = MeshCP(Curve=top, Mesh=mesh_4, Tol_2=0.01)  # -> Curve, ID
from_mesh = FromMesh(Mesh=mesh_4, ID=0, It=1000)  # -> Mesh, VertexID, Polylines
fromp = FromPolylines(Curves=meshcrv.Curve, Min_Triangulation=True)
crv_2 = Curve(from_mesh.Polylines)
projectnaked = ProjectNakedEdgeToCurves(Mesh=fromp, Curves=crv_2, Iteration=Slider(124, range=0..210), Tolerance=Slider(363, range=0..1110))
top_2 = GetPolylines(Mesh=projectnaked)
fromp_2 = FromPolylines(Curves=top_2, Min_Triangulation=False)
simplify_2 = Simplify(Mesh=fromp_2)

# ----
# Utilities
# Mesh Pipe
number_slider_3 = Slider(5, range=0..100)
number_slider_4 = Slider(100, range=0..1005)
# Tutorials: https://www.learn-visual-programming.com/
# 
# Support: petrasvestartas@gmail.com
# 
# Coffee or Beer : https://ko-fi.com/petrasvestartas
crv_3 = Curve(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)
meshpipe = MeshPipe(Curve=crv_3, Radius=number_slider_3, Sides=6, Tolerance=number_slider_4, Ending=number_slider_4)

number_slider_5 = Slider(20, range=0..40)
crv_4 = Curve([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])
brep_2 = Brep(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)
meshpipe_2 = MeshPipe(
    Curve=crv_4,
    Radius=Slider(20, range=0..500),
    Sides=Slider(6, range=0..30),
    Tolerance=Slider(70, range=0..100),
    Ending=Slider(2, range=0..4))  # -> graft(Mesh)
dividebox = DivideBox(Box=brep_2, X=number_slider_5, Y=number_slider_5, Z=number_slider_5)
minc = MeshInclusion(Mesh=meshpipe_2, Point=dividebox, Strict=False)
cull = CullPattern(List=dividebox, CullPattern=minc)  # -> flatten(List)
flip = FlipMatrix(Data=minc)
ma = MassAddition(Input=flip)  # -> flatten(Result), PartialResults
bool = Boolean(ma.Result)
isosurface = IsoSurface(
    Box=brep_2,
    Values=bool,
    XResolution=number_slider_5,
    YResolution=number_slider_5,
    ZResolution=number_slider_5,
    IsoValue=Slider(0.01, range=0..2),
    MergeVertices=invert(False))
meshedges = MeshEdges(Mesh=isosurface)  # -> AllE, NakedE
previewedges_2 = PreviewEdges(Mesh=isosurface, Tolerance=0.49)
weld = WeldMesh(Mesh=isosurface, Radius=Slider(-3, range=-10..-3), Align=False, Use_RTree=False)
preview = CustomPreview(
    Geometry=weld,
    Material={diffuse=RGB(199, 199, 199), emission=RGB(60, 60, 60), shine=0.5, specular=RGB(255, 255, 255), transparency=0})
display = CurvePreview(Curve=meshedges.AllE, Width=1, Colour=ColourSwatch(SwatchColor=RGB(51, 51, 51)))
display_2 = CurvePreview(Curve=[previewedges_2, meshedges.NakedE], Width=3)

number_slider_6 = Slider(30, range=0..40)
crv_5 = Curve([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])
meshpipe_3 = MeshPipe(Curve=crv_5, Radius=Slider(20, range=0..500), Sides=6, Tolerance=Slider(70, range=0..100), Ending=Slider(2, range=0..4))  # -> graft(Mesh)
brep_3 = Brep(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)
dividebox_2 = DivideBox(Box=brep_3, X=number_slider_6, Y=number_slider_6, Z=number_slider_6)
minc_2 = MeshInclusion(Mesh=meshpipe_3, Point=dividebox_2, Strict=False)
cull_2 = CullPattern(List=dividebox_2, CullPattern=minc_2)  # -> flatten(List)
voxels_2 = Voxels(Points=cull_2, Scale=Slider(0.209, range=0..3))  # -> Mesh, Points
weld_2 = WeldMesh(Mesh=voxels_2.Mesh, Radius=Slider(-3, range=-10..-3), Align=False, Use_RTree=False)
previewedges_3 = PreviewEdges(Mesh=weld_2, Tolerance=0.49)
preview_2 = CustomPreview(
    Geometry=weld_2,
    Material={diffuse=RGB(199, 199, 199), emission=RGB(60, 60, 60), shine=0.5, specular=RGB(255, 255, 255), transparency=0})
display_3 = CurvePreview(Curve=previewedges_3)

crv_6 = Curve([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])
X = UnitX(Factor=Slider(30, range=0..30))
X_2 = UnitX(Factor=Slider(60, range=0..60))
X_3 = UnitX(Factor=Slider(90, range=0..90))

# ----
# Smooth Mesh
number_slider_7 = Slider(114, range=0..400)
mesh_5 = Mesh(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)

weldmesh = WeldMesh(Mesh=mesh_5, Radius=0.001, Align=False, Use_RTree=False)

smooth = Smooth(Mesh=weldmesh, Value=Slider(1, range=0..10), Iterations=number_slider_7, Fixed=True)

# ----
# Mesh Curvature and Mesh Explode
swatch = ColourSwatch(SwatchColor=RGB(255, 255, 255))
mesh_6 = Mesh(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)
list = ValueList({"Quadratic fitting 3 coefficients": 0, "Quadratic fitting 4 coefficients": 1, "Quadratic fitting 6 coefficients": 2, "Cubic fitting 7 coefficients": 3}, selected="Quadratic fitting 3 coefficients")
merge = Merge(Data1=ColourSwatch(SwatchColor=RGB(0, 174, 255)), Data2=swatch, Data3=ColourSwatch(SwatchColor=RGB(255, 0, 149)))
list_2 = ValueList({"min": 0, "max": 1, "gaussian": 2, "mean": 3, "absolute": 4, "difference": 5, "rms": 6}, selected="min")

weldmesh_2 = WeldMesh(Mesh=mesh_6, Radius=0.001, Align=False, Use_RTree=False)

mesh_curvature = MeshCurvature(Mesh=weldmesh_2, CurvatureType=list_2, Radius=2, Method=list, Interval=Domain(0, 0), _3Colors=merge, On=Toggle(True))  # -> Mesh, CurvatureValues
explodemesh = ExplodeMesh(Mesh=mesh_curvature.Mesh, Explode=invert(False))
area_2 = Area(Geometry=explodemesh)  # -> Area, Centroid
avr = Average(Input=area_2.Centroid)
vec2pt = Vector2Pt(PointA=avr, PointB=area_2.Centroid, Unitize=False)  # -> Vector, Length
amp = Amplitude(Vector=vec2pt.Vector, Amplitude=Slider(1, range=0..10))
move = Move(Geometry=explodemesh, Motion=amp)  # -> Geometry, Transform

move_2 = Move(Geometry=mesh_curvature.Mesh, Motion=X)  # -> Geometry, Transform
move_3 = Move(Geometry=explodemesh, Motion=X_2)  # -> Geometry, Transform
move_4 = Move(Geometry=move.Geometry, Motion=X_3)  # -> Geometry, Transform
getpolylines = GetPolylines(Mesh=[move_2.Geometry, move_3.Geometry, move_4.Geometry])
