# Grasshopper definition 9_ZollingerAndNexoradeStudies.gh (Grasshopper 1.0.7)
# plug-ins: NGon 2.1

# ---- group: Clean Mesh
# Tiling Method
brep = Brep(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)
diamonddivide = DiamondDivide(
    Surface=brep,
    U=Slider(20, range=0..80),
    V=Slider(20, range=0..40),
    Boundary=Slider(0, range=-1..1),
    Swap=invert(True),
    Flip=True,
    Divisions=False,
    Explode=True)
corners = Corners(Mesh=diamonddivide, Angle=135)  # -> Corners, ID
simplify = Simplify(Mesh=diamonddivide, Fixed=corners.Corners)
weld = WeldMesh(Mesh=simplify, Radius=0.1, Align=False, Use_RTree=True)
top = GetPolylines(Mesh=flatten(weld))  # -> flatten(Polylines)
fromp = FromPolylines(Curves=top, Min_Triangulation=True)
unify = UnifyWindings(Mesh=fromp)
mesh = Mesh(unify)

# ----
# Rotate Mesh edge according to average Normal
# And cut end parts
number_slider = Slider(8, range=0..10)  # disabled
number_slider_2 = Slider(5, range=0..10)  # disabled
brep_2 = Brep(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)  # disabled
hexdivide = HexDivide(
    Surface=brep_2,
    U=number_slider,
    V=number_slider_2,
    Parameter=0.25,
    Boundary=0,
    Swap=True,
    Rebuild=9,
    Quadrangulate=False,
    Divisions=False,
    Explode=True)  # -> Mesh, DistA, DistB; disabled
number_slider_3 = Slider(0.22, range=0..1)  # disabled
top_2 = GetPolylines(Mesh=hexdivide.Mesh)  # disabled
number_slider_4 = Slider(1, range=0..1)  # disabled
fromp_2 = FromPolylines(Curves=top_2, Min_Triangulation=False)  # disabled
recipricalextend = RecipricalExtend(Mesh=fromp_2, Angle=number_slider_3, Scale=1.4, NormalType=True, Height=1)  # -> CM, C0, C1, P, EP; disabled
curveloft = CurveLoft(
    CurveFirst=graft(recipricalextend.C0),
    Curves=graft(recipricalextend.C1),
    DivisionsU=number_slider_4,
    DivisionsV=number_slider_4)  # -> Mesh, D; disabled
mesh_2 = Mesh(curveloft.Mesh)  # disabled

# ----
# Or whatever they are called, nobody share their code so you have to write your own...
# Rotate Mesh edge according to average Normal
number_slider_5 = Slider(8, range=0..10)  # disabled
number_slider_6 = Slider(5, range=0..10)  # disabled
# Zollinger / Reciprocal / Nexorades
brep_3 = Brep(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)  # disabled
hexdivide_2 = HexDivide(
    Surface=brep_3,
    U=number_slider_5,
    V=number_slider_6,
    Parameter=0.25,
    Boundary=0,
    Swap=True,
    Rebuild=9,
    Quadrangulate=False,
    Divisions=False,
    Explode=True)  # -> Mesh, DistA, DistB; disabled
top_3 = GetPolylines(Mesh=hexdivide_2.Mesh)  # disabled
number_slider_7 = Slider(0.27, range=0..1)  # disabled
number_slider_8 = Slider(1.42, range=0..2)  # disabled
fromp_3 = FromPolylines(Curves=top_3, Min_Triangulation=False)  # disabled
recipricaledges = RecipricalEdges(Mesh=fromp_3, Angle=number_slider_7, Scale=number_slider_8, NormalType=True)  # -> Curve, ID0, ID1, Vectors; disabled

# ----
# Rotation with Joints
brep_4 = Brep(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)  # disabled
number_slider_9 = Slider(10, range=0..10)  # disabled
number_slider_10 = Slider(9, range=0..10)  # disabled
number_slider_11 = Slider(0.286, range=0..1)  # disabled
crv = Curve([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])  # disabled
number_slider_12 = Slider(0.5, range=0..10)  # disabled
crv_2 = Curve([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])  # disabled
topoly = CurveToPolyline(Curve=crv_2, ToleranceDistance=0, ToleranceAngle=0)  # -> Polyline, Segments; disabled
topoly_2 = CurveToPolyline(Curve=crv, ToleranceDistance=0, ToleranceAngle=0)  # -> Polyline, Segments; disabled
hexdivide_3 = HexDivide(
    Surface=brep_4,
    U=number_slider_9,
    V=number_slider_10,
    Parameter=0.25,
    Boundary=0,
    Swap=True,
    Rebuild=9,
    Quadrangulate=False,
    Divisions=False,
    Explode=True)  # -> Mesh, DistA, DistB; disabled
top_4 = GetPolylines(Mesh=hexdivide_3.Mesh)  # disabled
fromp_4 = FromPolylines(Curves=top_4, Min_Triangulation=False)  # disabled
recipricalvolume = RecipricalVolume(
    Mesh=fromp_4,
    Angle=number_slider_11,
    Scale=1.4,
    NormalType=True,
    Height=1,
    Offset=2,
    Thickness=1,
    RoofSurface=brep_4,
    JointMale=topoly_2.Polyline,
    JointFemale=topoly.Polyline,
    W1=number_slider_12,
    W2=number_slider_12)  # -> CM, C0, C1, P, EP, I0, FP, CL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; disabled
number_slider_13 = Slider(10, range=0..10)  # disabled
loft = LoftPolylines(Curve0=recipricalvolume.Structure, Fast=invert(True))  # -> simplify(Mesh); disabled
crv_3 = Curve(simplify(recipricalvolume.Tenon))  # disabled
curveloft_2 = CurveLoft(CurveFirst=graft(recipricalvolume.C0), Curves=graft(recipricalvolume.C1), DivisionsU=1, DivisionsV=1)  # -> Mesh, D; disabled
item = ListItem(List=recipricalvolume.FP, Index=0, Wrap=True)  # -> Item, Item1, Item2, Item3; disabled
trim = TrimTree(Tree=crv_3, Depth=1)  # disabled
boundary = BoundarySurfaces(Edges=item.Item)  # disabled
branch = TreeBranch(Tree=loft, Path=number_slider_13, MaintainPaths=True)  # disabled
branch_2 = TreeBranch(Tree=trim, Path=number_slider_13, MaintainPaths=True)  # disabled
mesh_3 = Mesh(loft)  # disabled

# ----
# Reciprocal from mesh with thickness
number_slider_14 = Slider(292, range=0..1000)  # disabled
number_slider_15 = Slider(247, range=0..1000)  # disabled
number_slider_16 = Slider(38.75, range=0..90)  # disabled
number_slider_17 = Slider(0.03, range=0..0.3)  # disabled
crv_4 = Curve(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)  # disabled
number_slider_18 = Slider(0.75, range=0..1)  # disabled
pop2d = Populate2D(Region=crv_4, Count=number_slider_14, Seed=number_slider_15)  # disabled
del = DelaunayMesh(Points=pop2d, Plane=PlaneXY(0, 0, 0))  # -> flatten(Mesh); disabled
mjoin = MeshJoin(Meshes=del)  # disabled
offset = OffsetCurve(Curve=crv_4, Distance=expr("-x", number_slider_18), Plane=PlaneXY(0, 0, 0), Corners=1)  # disabled
voronoi = Voronoi(Points=pop2d, Radius=crv_4, Boundary=crv_4, BruteForceOverride=False)  # disabled
disc = Discontinuity(Curve=voronoi, Level=1)  # -> Points, Parameters; disabled
recipricalthickness = RecipricalThickness(Mesh=mjoin, Angle=number_slider_16, Distance=number_slider_17, Width=0.1)  # disabled
scx = SurfaceCurve(Surface=offset, Curve=recipricalthickness)  # -> Curves, Points, UVPoints, Normals, Parameters, Tangents; disabled

# ---- group: Tiling
crv_5 = Curve(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)
cluster = Cluster(C=crv_5)
c_script = CSharpScript(T0=crv_5, r="0.02", Reference="C:\Users\petra\AppData\Roaming\Grasshopper\6\Libraries\Ngons\NGonsCore.dll")  # -> out, Tiles2D, A, B; inputs T0: Polyline, r: Double
# ---------- c_script: C# usings ----------
using NGonsCore;
# ---------- c_script: C# ----------
    Component.Message = "Create Tile \n 1 Quad \n 4 Half-tri \n 4 Quarter-tri";


    var lines = QuadTile0(T0, r);

    List<NGonsCore.Tile2D> tiles = new List<NGonsCore.Tile2D>();

    //4 edge tile
    DataTree<Polyline> dt = new DataTree<Polyline>();
    dt.AddRange(lines, new GH_Path(0, 0));
    List < Polyline>[] crvs_ = new List<Polyline>[]{new List<Polyline>(){lines[0]},new List<Polyline>(){lines[1]},new List<Polyline>(){lines[2]},new List<Polyline>(){lines[3]}};
    NGonsCore.Tile2D tile2D = new NGonsCore.Tile2D(0,T0, crvs_, new int[]{0,1,2,3}, new int[]{0,1,2,3}, new int[]{0,0}, new int[]{1,3});
    tiles.Add(tile2D);


    //2 edge tiles
    for(int i = 0; i < 4; i++){

      int id0 = i;
      int id1 = (i + 1) % 4;
      int id2 = (i + 2) % 4;


      Point3d p0 = T0[id0];
      Point3d p1 = T0[id1];
      Point3d p2 = T0[id2];

      int id2In = (id1 % 2 == 0) ? -1 : -1;

      Polyline pline = new Polyline(new Point3d[]{p0,p1,p2,p0});

      List<Polyline>[] crvs = new List<Polyline>[]{new List<Polyline>(),new List<Polyline>(),new List<Polyline>()};
      int[] ids = new int[]{id0,id1,id2In};

      //Trim polylines and assign id
      foreach(Polyline l in lines){

        int id = -1;
        Curve c = IntersectClosedOpenCurve(pline.ToNurbsCurve(), l.ToNurbsCurve(), ref id, new int[]{0,1});

        if(c != null && id != -1){
          Print(id.ToString());
          Polyline trimedPolyline;
          c.TryGetPolyline(out trimedPolyline);
          crvs[id].Add(trimedPolyline);
        }
      }

      //display
      for(int j = 0; j < crvs.Length; j++){
        dt.AddRange(crvs[j], new GH_Path(i + 1, j));
        dt.Add(pline, new GH_Path(i + 1, j));
      }


      NGonsCore.Tile2D tile2DHalf = new NGonsCore.Tile2D(i+1,pline, crvs, ids, ids, new int[]{id0}, new int[]{id1});
      //Rhino.RhinoApp.WriteLine(id0.ToString() + " " + id1.ToString());
      //NGonsCore.Tile2D tile2DHalf = new NGonsCore.Tile2D(pline, crvs, ids, ids, new int[]{0}, new int[]{1});
      tiles.Add(tile2DHalf);

    }

    //1 edge tiles

    for(int i = 0; i < 4; i++){



      int id0 = i;
      int id1 = (i + 1) % 4;
      //int id2 = (i + 2) % 4;


      Point3d p0 = T0[id0];
      Point3d p1 = T0[id1];
      Point3d p2 = Point3d.Origin;



      Polyline pline = new Polyline(new Point3d[]{p0,p1,p2,p0});

      List<Polyline>[] crvs = new List<Polyline>[]{new List<Polyline>(),new List<Polyline>(),new List<Polyline>()};
      int id1In = (id1 % 2 == 0) ? -1 : -1;
      int id2In = (id1 % 2 == 0) ? -1 : -1;
      int[] ids = new int[]{id0,id1In,id2In};

      //Trim polylines and assign id
      foreach(Polyline l in lines){

        int id = -1;
        Curve c = IntersectClosedOpenCurve(pline.ToNurbsCurve(), l.ToNurbsCurve(), ref id, new int[]{0});

        if(c != null && id != -1){
          Print(id.ToString());
          Polyline trimedPolyline;
          c.TryGetPolyline(out trimedPolyline);
          crvs[id].Add(trimedPolyline);
        }
      }

      NGonsCore.Tile2D tile2DQuarter = new NGonsCore.Tile2D(i+4,pline, crvs, ids, ids, new int[0], new int[0]);
      tiles.Add(tile2DQuarter);

      //display
      for(int j = 0; j < crvs.Length; j++){
        dt.AddRange(crvs[j], new GH_Path(4 + i + 1, j));
        dt.Add(pline, new GH_Path(4 + i + 1, j));
      }
    }





    A = tiles;
    B = dt;
    Tiles2D = new GH_ObjectWrapper(tiles);
    //Display
# ---------- c_script: C# additional code ----------
  public Curve IntersectClosedOpenCurve(Curve c0, Curve c1, ref int id, int[] prioritySegments){

    Rhino.Geometry.Intersect.CurveIntersections ci = Rhino.Geometry.Intersect.Intersection.CurveCurve(c0, c1, 0.1, 0.1);

    Curve crv = null;
    id = -1;
    switch(ci.Count){

      case(2):
        //        Rhino.RhinoApp.WriteLine();
        //        Rhino.RhinoApp.WriteLine("Two Points");

        double t0 = ci[0].ParameterB;
        double t1 = ci[1].ParameterB;
        if( ((t0 == 0) && (t1 == 1)) || ((t0 == 1) && (t1 == 0))){
          crv = c1;

        }else{
          crv = t0 < t1 ? c1.Trim(t0, t1) : c1.Trim(t1, t0);
        }

        //Rhino.RhinoApp.WriteLine(t0.ToString() + " " + t1.ToString());
        //find closest id
        Polyline polyline;
        c0.TryGetPolyline(out polyline);
        polyline.RemoveAt(polyline.Count - 1);

        //priority segments
        int nakedID = -1;
        int clothedID = -1;
        foreach(var cii in ci){
          nakedID = (int) Math.Floor(cii.ParameterA);

          if( Array.IndexOf(prioritySegments, nakedID) != -1 ){
            clothedID = nakedID;
            break;
          }
        }

        id = (clothedID != -1) ? clothedID : nakedID;

        //Rhino.RhinoDoc.ActiveDoc.Objects.AddCurve(crv  );
        //Rhino.RhinoApp.WriteLine("id" + id.ToString());

        break;
      case(1):
        //Rhino.RhinoApp.WriteLine();
        //Rhino.RhinoApp.WriteLine("One Points");

        PointContainment pc0 = c0.Contains(c1.PointAtStart, Plane.WorldXY, 0.01);
        PointContainment pc1 = c0.Contains(c1.PointAtEnd, Plane.WorldXY, 0.01);
        // Rhino.RhinoApp.WriteLine(pc0.ToString() + " " + pc1.ToString());

        if(pc0 == PointContainment.Inside  ){
          //Rhino.RhinoDoc.ActiveDoc.Objects.AddCurve(c1);
          crv = ci[0].ParameterB == 0 ? c1.Trim(ci[0].ParameterB, c1.Domain.T1) : c1.Trim(0.0, ci[0].ParameterB);
          //Rhino.RhinoApp.WriteLine("0.0 " +  ci[0].ParameterB.ToString());
          //Rhino.RhinoDoc.ActiveDoc.Objects.AddCurve(crv);
          id = (int) Math.Floor(ci[0].ParameterA);
        } else if(pc1 == PointContainment.Inside ){
          crv = c1.Trim(ci[0].ParameterB, c1.Domain.T1);
          crv = ci[0].ParameterB == c1.Domain.T1 ? c1.Trim(c1.Domain.T1, ci[0].ParameterB) : c1.Trim(ci[0].ParameterB, c1.Domain.T1);
          //Rhino.RhinoDoc.ActiveDoc.Objects.AddCurve(crv);
          id = (int) Math.Floor(ci[0].ParameterA);
        }

        break;
    }

    return crv;

  }

  public List<Polyline> QuadTile0  (Polyline T0, double r){

    //Create lines
    double t0 = -r;
    var pt0 = T0.PointAt(0.5 - t0);
    var pt1 = T0.PointAt(1.5 + t0);
    var pt2 = T0.PointAt(2.5 - t0);
    var pt3 = T0.PointAt(3.5 + t0);

    Point3d c = T0.CenterPoint();
    Line l = new Line(pt0, pt2);

    Line l0 = new Line(pt0, c);
    Line l1 = new Line(pt1, l.ClosestPoint(pt1, false));
    l1.Transform(Transform.Scale(l1.From, 0.98));
    Line l2 = new Line(c, pt2);
    Line l3 = new Line(l.ClosestPoint(pt3, false), pt3);
    l3.Transform(Transform.Scale(l3.To, 0.98));


    List<Polyline> lines = new List<Polyline>(){
        l0.ToPolyline(),
        l1.ToPolyline(),
        l2.ToPolyline(),
        l3.ToPolyline(),

        };

    return lines;
  }

  public List<Polyline> QuadTile1  (Polyline T0, double r){

    //Create lines
    double t0 = -r;
    var pt0 = T0.PointAt(1);
    var pt1 = T0.PointAt(2.0 + t0);
    var pt2 = T0.PointAt(3);
    var pt3 = T0.PointAt(4.0 + t0);

    Point3d c = T0.CenterPoint();
    Line l = new Line(pt1, pt3);

    Line l0 = new Line(pt1, c);
    Line l1 = new Line(pt0, l.ClosestPoint(pt0, false));
    l1.Transform(Transform.Scale(l1.From, 0.999));
    Line l2 = new Line(c, pt3);
    Line l3 = new Line(l.ClosestPoint(pt2, false), pt2);
    l3.Transform(Transform.Scale(l3.To, 0.999));


    List<Polyline> lines = new List<Polyline>(){
        l0.ToPolyline(),
        l1.ToPolyline(),
        l2.ToPolyline(),
        l3.ToPolyline(),





        };

    return lines;
  }
# ---------- end c_script ----------

bfs = BFS(Mesh=mesh, Start="0", Angle=0.14)  # -> Vertices, simplify(Edges), EdgeVec, Bad, Mesh, FaceVec
c_script_2 = CSharpScript(
    M=mesh,
    E=bfs.Edges,
    Tiles2D=c_script.Tiles2D,
    Reference="C:\Users\petra\AppData\Roaming\Grasshopper\6\Libraries\Ngons\NGonsCore.dll")  # -> out, Tiles2DMapped, lines, A; inputs M: Mesh, E: tree of Int32
# ---------- c_script_2: C# usings ----------
using NGonsCore;
using System.Linq;
# ---------- c_script_2: C# ----------
    Component.Message = "Run Tiling";
    try{
      //////////////////////////////////////////////////////////////
      //Inputs
      //////////////////////////////////////////////////////////////
      List<Tile2D> td = (List<Tile2D>) (Tiles2D);
      Tile2D[] tiles = new Tile2D[M.Ngons.Count];

      HashSet<int> h = new HashSet<int>();
      Polyline[] plines = M._Polylines();
      Plane[] planes = M._FPlanes();

      tDisplay = new Rhino.Display.Text3d[M.Ngons.Count][];
      bbox = M.GetBoundingBox(false);


      //////////////////////////////////////////////////////////////
      //Iterate bfs
      //////////////////////////////////////////////////////////////

      //1. Find First Tile
      int f = E.Branch(0)[0];
      tiles[f] = GetTile(td, plines[f].Count - 1);

      tiles[f].Map(plines[f]);
      GetDisplay(f, plines[f], planes[f], tiles[f]);

      //2. Find the rest of tile orientation

      int[] e = new int[]{0,1,2,3};
      int[] n = new int[]{3,2,1,0};

      //Rhino.RhinoApp.ClearCommandHistoryWindow();
      for(int i = 0; i < E.BranchCount; i++){//E.BranchCount
        //Rhino.RhinoApp.WriteLine(i.ToString());
        //2.1 Find common edges
        int f0 = E.Branch(i)[0];//Local a and local b
        int f1 = E.Branch(i)[1];
        int[] ce = CommonEdge(M, f0, f1);//common local edges


        //Get last tile mask
        int f0E = tiles[f0].e[ce[0]];
        int neiMask = n[f0E];

        //Get masks fot the next
        int[] fe = M._fe(f1);
        int[] maskIDS = new int[fe.Length];

        for(int j = 0; j < maskIDS.Length; j++){

          int start = ce[1];
          int eID = NGonsCore.MathUtil.Wrap((start + f0E - j), 4);
          int nextID = n[eID];

          //Indetify naked edges, this part is wrong
          if(maskIDS.Length == 3){
            if(M.TopologyEdges.GetConnectedFaces(fe[j]).Length == 1)
              nextID = -1;
          }


          //not clean
          if(maskIDS[0] != -1){
            if(j == maskIDS.Length - 1 && nextID != -1){
              nextID = NGonsCore.MathUtil.Wrap(maskIDS[0] - 1, 4);
            }
          }

          maskIDS[j] = nextID;
          // Rhino.RhinoApp.WriteLine(nextID.ToString());
        }

        //Rhino.RhinoApp.WriteLine();

        //2.2 Get not mapped tile

        tiles[f1] = GetTile(td, plines[f1].Count - 1, maskIDS);

        if(tiles[f1] == null){
          Rhino.RhinoApp.WriteLine(" " + (plines[f1].Count - 1).ToString()
            + " " + maskIDS[0].ToString()
            + " " + maskIDS[1].ToString()
            + " " + maskIDS[2].ToString()
            + " faces " + f0.ToString()
            + " " + f1.ToString()

            );
          break;

        }


        //Local Edge id

        //Rhino.RhinoApp.WriteLine(i.ToString() + " " + f1.ToString());
        //Rhino.RhinoApp.WriteLine(tiles[f1].ToString());
        int f1E = tiles[f1].e[ce[1]];



        //2.3 Rotate tiles until criteria is met

        int shiftTimes = 0;
        for(int j = 0; j < 5; j++){

          if(n[f0E] == f1E)
            break;
          tiles[f1].Shift();
          tiles[f1].ShiftPolylines();
          f1E = tiles[f1].e[ce[1]];
          shiftTimes++;
        }



        tiles[f1].shiftTimes = shiftTimes;


        //2.4 Map tile to mesh face polyline
        tiles[f1].Map(plines[f1]);
        GetDisplay(f1, plines[f1], planes[f1], tiles[f1]);
      }

      ////////////////////////////////////////////////////////////
      //Checker pattern
      ////////////////////////////////////////////////////////////
      bool[] checker = NGonsCore.Graphs.UndirectedGraphBfsRhino.Checker(M);

      for(int i = 0; i < tiles.Length; i++){

        tiles[i].eFlag = new bool[tiles[i].e.Length];

        for(int j = 0; j < tiles[i].e.Length; j++){
          tiles[i].eFlag[j] = Math.Abs(tiles[i].e[j]) % 2 == Convert.ToInt32(checker[i]) ? true : false;
        }

      }

      _tmap = GetTileOutlines(tiles);
      lines_ = _tmap;
      Tiles2DMapped_ = new GH_ObjectWrapper(tiles);
      A = checker;
    }catch(Exception e){
      Rhino.RhinoApp.WriteLine(e.ToString());
    }
# ---------- c_script_2: C# additional code ----------
  BoundingBox bbox;
  public Rhino.Display.Text3d[][] tDisplay;
  public DataTree<Polyline> _tmap;

  public Tile2D GetTile(List<Tile2D> td, int sides, int[] maskIDS = null){
    //Rhino.RhinoApp.WriteLine(" ");
    for(int i = 0; i < td.Count; i++){

      //if sidecount is the same
      if(td[i].e.Length == sides){

        Tile2D tileTemp = td[i].Duplicate();


        //Rhino.RhinoApp.WriteLine((maskIDS != null).ToString());
        if(maskIDS != null){



          bool flag = true;
          //Rhino.RhinoApp.WriteLine();

          int[] tdECopy = new int[td[i].e.Length];
          Array.Copy(td[i].e, tdECopy, td[i].e.Length);
          foreach(int maskID in maskIDS){
            //Rhino.RhinoApp.WriteLine(maskID.ToString());
            int isInTile = Array.IndexOf(tdECopy, maskID);
            if( isInTile == -1){
              flag = false;
              break;
            }else{
              tdECopy[isInTile] = -9;
            }
          }

          //Rhino.RhinoApp.WriteLine(flag.ToString());

          if(!flag){
            continue;
          }
        }

        // Rhino.RhinoApp.WriteLine();

        //Rhino.RhinoApp.WriteLine("_______________");
        //        if(tileTemp.adj0.Length != 0){
        //          Print("TileID " + i.ToString() + " _______ " + tileTemp.adj0[0] + " " + tileTemp.adj1[0]);
        //        }else{
        //          Print("TileID " + i.ToString());
        //        }
        return tileTemp;

      }
    }
    Rhino.RhinoApp.WriteLine("Returned Null Tile");
    return null;
  }


  public void GetDisplay(int f, Polyline pline, Plane plane, Tile2D t){
    Polyline scalePline = pline.Duplicate();
    scalePline.Transform(Transform.Scale(plane.Origin, 0.75));
    Rhino.Display.Text3d[] txt = new Rhino.Display.Text3d[pline.SegmentCount];

    for(int i = 0; i < pline.SegmentCount; i++){
      Plane textPlane = new Plane(plane);
      textPlane.Origin = scalePline.PointAt(i + 0.5);

      Rhino.Display.Text3d entity = new Rhino.Display.Text3d(t.e[i].ToString(), textPlane, 200);

      txt[i] = entity;
    }

    tDisplay[f] = txt;

  }

  public  int[] CommonEdge(Mesh M, int F0, int F1) {

    int[] e0 = M._fe(F0);
    int[] e1 = M._fe(F1);


    var common = e0.Intersect(e1);

    if (common.Count() > 0){

      int commonEdge = common.First();

      int a = 0;
      int b = 0;

      for(int i = 0; i < e0.Length; i++){
        if(commonEdge == e0[i]){
          a = i;
          break;
        }
      }

      for(int i = 0; i < e1.Length; i++){
        if(commonEdge == e1[i]){
          b = i;
          break;
        }
      }

      return new int[]{a,b};


    }else
      return new int[]{-1,-1};
  }





  //Output methods
  public DataTree<Polyline> GetTileOutlines(Tile2D[] tm){
    DataTree<Polyline> dt = new  DataTree<Polyline>();
    for(int i = 0; i < tm.Length; i++){
      if(tm[i] != null){
        for(int j = 0; j < tm[i].geo.Length; j++){
          dt.AddRange(tm[i].geo[j], new GH_Path(i, j));
        }
      }
    }
    return dt;
  }

  //Return a BoundingBox that contains all the geometry you are about to draw.
  public override BoundingBox ClippingBox
  {
    get
    {
      return bbox;
    }
  }

  //Draw all meshes in this method.
  public override void DrawViewportMeshes(IGH_PreviewArgs args)
  {
  }

  //Draw all wires and points in this method.
  public override void DrawViewportWires(IGH_PreviewArgs args)
  {

    foreach(var l in this._tmap.AllData()){
      args.Display.DrawArrow(new Line(l[0], l[l.Count - 1]), System.Drawing.Color.Black);
    }


    foreach(var array in tDisplay){
      if(array != null){
        foreach(var element in array){
          args.Display.Draw3dText(element, System.Drawing.Color.Black);
        }
      }
    }

  }
# ---------- end c_script_2 ----------
c_script_3 = CSharpScript(
    M=mesh,
    Tiles2DMapped=c_script_2.Tiles2DMapped,
    Tolerance=Slider(0.03, range=0..0.11),
    RunPipes3d=Toggle(False),
    Reference="C:\Users\petra\AppData\Roaming\Grasshopper\6\Libraries\Ngons\NGonsCore.dll")  # -> out, tiles, ccDt, ccDtPlines, ccDtLines, ccDtZAxis, ccDtDir, pipes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; inputs M: Mesh, Tolerance: Double, RunPipes3d: Boolean
# ---------- c_script_3: C# ----------
    try{
      Component.Message = "Connected Components \n F   e[j]   j";

      //////////////////////////////////////////////////////////////
      //Inputs
      //////////////////////////////////////////////////////////////

      Tile2D[] tiles = (Tile2D[]) (Tiles2DMapped);

      Polyline[] plines = M._Polylines();
      Plane[] planes = M._FPlanes();

      tDisplay = new Rhino.Display.Text3d[M.Ngons.Count][];
      tDisplayEdges = new Rhino.Display.Text3d[M.Ngons.Count][];
      bbox = M.GetBoundingBox(false);

      int eCount = 0;
      Dictionary<int,int> eCountF = new Dictionary<int,int>();
      Dictionary<int,int[]> v_FE = new Dictionary<int,int[]>();
      for(int i = 0; i < M.Ngons.Count; i++){
        eCountF.Add(i, eCount);
        GetDisplay(i, plines[i], planes[i], tiles[i], eCount);
        for(int j = 0; j < tiles[i].e.Length; j++){
          v_FE.Add(eCount + j, new int[]{i,j});
        }
        eCount += tiles[i].e.Length;


      }
      tiles_ = tiles;


      //////////////////////////////////////////////////////////////
      //A Construct UWG and GetConnectedComponents
      //////////////////////////////////////////////////////////////


      NGonsCore.Graphs.UndirectedWeightedGraph g = new NGonsCore.Graphs.UndirectedWeightedGraph(eCount);

      //////////////////////////////////////////////////////////////
      //A.1 Add Vertices if they have geometry
      //////////////////////////////////////////////////////////////
      for (int i = 0; i < tiles.Length; i++){
        for(int j = 0; j < tiles[i].e.Length; j++){
          if(tiles[i].geo[j].Count != 0){//skip vertices without geometry
            g.InsertVertex(
              i.ToString() + ";"
              + tiles[i].e[j] + ";"
              + j
              );
          }//if
        }//for j
      }//for i

      //////////////////////////////////////////////////////////////
      //A.2 Add Edges per tile to connect two continuous bars
      //////////////////////////////////////////////////////////////
      for (int i = 0; i < tiles.Length; i++){

        if(tiles[i].e.Length == 4){

          List<int> ids = new List<int>();

          for(int j = 0; j < tiles[i].e.Length; j++){
            if( tiles[i].e[j] == 0 || tiles[i].e[j] == 2 ) {
              ids.Add(j);
            }// if
          }//for


          g.InsertEdge(
            
            string.Format("{0};{1};{2}", i, tiles[i].e[ids[0]], ids[0]),
            string.Format("{0};{1};{2}", i, tiles[i].e[ids[1]], ids[1]),
            1);

        }
      }

      //////////////////////////////////////////////////////////////
      //A.3 Add Edges per neighbour-edge
      //////////////////////////////////////////////////////////////
      int[][] ef = M.GetNgonsConnectedToNGonsEdges(M.GetAllNGonEdges(M.GetNGonsTopoBoundaries()), true);


      for(int i = 0; i < ef.Length; i++){

        //Find common edges - Local a and local b
        int f0 = ef[i][0];
        int f1 = ef[i][1];

        if(f0 != -1 && f1 != -1){

          int[] ce = CommonEdge(M, f0, f1); //common local edges
          
          
          if(f0 == 74 || f1 == 74){
            Print( string.Format("{0};{1};{2}", f0, tiles[f0].e[ce[0]], ce[0]) + " " +
             string.Format("{0};{1};{2}", f1, tiles[f1].e[ce[1]], ce[1]));
          }

          g.InsertEdge(
            string.Format("{0};{1};{2}", f0, tiles[f0].e[ce[0]], ce[0]),
            string.Format("{0};{1};{2}", f1, tiles[f1].e[ce[1]], ce[1]),
            1);

        }//if
      }//for


      //Connected componets
      List< NGonsCore.Graphs.UndirectedWeightedGraph> cc = g.ConnectedComponents(g, true);


      //Create DataTree for components and geometry
      var ccDt = new DataTree<string>();
      var ccDtPlines = new DataTree<Polyline>();

      for(int i = 0; i < cc.Count; i++){
        for(int j = 0; j < cc[i].VertexList.Length; j++){
          
          ccDt.Add(cc[i].VertexList[j].name, new GH_Path(i));

          var txt = cc[i].VertexList[j].name.Split(';');

          int f = Convert.ToInt32(txt[0]);
          int eMask = Convert.ToInt32(txt[1]);
          int e = Convert.ToInt32(txt[2]);

          List<Polyline> tilePlines = tiles[f].geo[e];
          ccDtPlines.AddRange(tilePlines, new GH_Path(i));
          
          
        }
      }




      //////////////////////////////////////////////////////////////
      //B Component connectivity
      //////////////////////////////////////////////////////////////

      DataTree<int> adjDt = new DataTree<int>();

      for (int i = 0; i < tiles.Length; i++){

        //Loop through tile adjacency
        for(int j = 0; j < tiles[i].adj0.Length; j++){

          if(tiles[i].e.Length == 3) {
            //Rhino.RhinoApp.WriteLine(tiles[i].adj0[j].ToString() + " " + tiles[i].adj1[j].ToString() + " " + i.ToString());
          }

          int adj0 = tiles[i].adj0[j];
          int adj1 = tiles[i].adj1[j];

          int f = i;
          int e0Mask = adj0;
          int e0 = -1;
          for(int k = 0; k < tiles[i].e.Length; k++){
            if( tiles[i].e[k] == e0Mask ){
              e0 = k;
              break;
            }
          }

          int e1Mask = adj1;
          int e1 = -1;
          for(int k = 0; k < tiles[i].e.Length; k++){
            if( tiles[i].e[k] == e1Mask ){
              e1 = k;
              break;
            }
          }

          //          if(tiles[i].e.Length == 3) {
          //            f = i;
          //            e0Mask = tiles[i].e[adj0];
          //            e0 = adj0;
          //
          //            e1Mask = tiles[i].e[adj1];
          //            e1 = adj1;
          //
          //          }






          string v0 = f.ToString() + ";" + e0Mask.ToString() + ";" + e0.ToString();
          string v1 = f.ToString() + ";" + e1Mask.ToString() + ";" + e1.ToString();

          //if(tiles[i].e.Length == 3) {
          //RhinoApp.WriteLine(string.Format("{0}  ______ {1}  ______  {2}", i, v0, v1));
          //Rhino.RhinoApp.WriteLine();
          //}

          //Iterate over graph and find which component two pairs belongs
          int id0 = -1;
          int id1 = -1;
          int localCounter = 0;


          for(int k = 0; k < cc.Count; k++){
            foreach(NGonsCore.Graphs.Vertex v in cc[k].VertexList){
              if(v.name == v0){
                id0 = k;
                localCounter++;
              }

              if(v.name == v1){
                id1 = k;
                localCounter++;
              }

              if(localCounter == 2){
                break;
              }
            }//foreach

          }


          if(tiles[i].e.Length == 3 && (id0 == -1 || id1 != -1 || id0 == id1)) {




            //Rhino.RhinoApp.WriteLine("Not Found " + v0.ToString() + "         " +v1.ToString());

          }

          //In this case there woudl be duplicates
          if(id0 != -1 && id1 != -1 && id0 != id1){
            //Rhino.RhinoApp.WriteLine("Found");
            adjDt.Add(id0, new GH_Path(id1));
            adjDt.Add(id1, new GH_Path(id0));
          }

        }//for j

      }


      //Remove component if it has no adjacencies

      for(int i = 0; i < cc.Count; i++){
        if(!adjDt.PathExists(new GH_Path(i))){
          adjDt.RemovePath(new GH_Path(i));
          ccDtPlines.RemovePath(new GH_Path(i));
          ccDt.RemovePath(new GH_Path(i));
        }
      }

      ccDtPlines_ = ccDtPlines;
      ccDt_ = ccDt;
      adjDt_ = adjDt;




      //////////////////////////////////////////////////////////////
      //C Get Axes - Construct Zollinger System
      //////////////////////////////////////////////////////////////

      var ccDtLines = new DataTree<Line>();
      var ccDtValid = new DataTree<bool>();
      var ccDtZAxis = new DataTree<Vector3d>();
      var ccDtDir = new DataTree<bool>();
      Zollinger zollinger = new Zollinger();
      var ccZol = new Dictionary<int,int>();
      var ccZol_ = new Dictionary<int,int>();
      for(int i = 0; i < ccDt.Paths.Count;i++) {

        GH_Path p = ccDt.Paths[i];


        //C.1 Get Polyline segments and order align them
        List<Polyline> polylines = new List<Polyline>();

        for(int j = 0; j < ccDt.Branch(p).Count;j++){
          int[] idCur = FEMaskE(ccDt.Branch(p)[j]);//first segment
          polylines.Add(tiles[idCur[0]].geo[idCur[2]][0]);
        }

        polylines = AlignSegments(polylines, 0.1);

        //C.2 Get Direction
        int[] id0 = FEMaskE(ccDt.Branch(p)[0]);//first segment
        bool direction = tiles[id0[0]].eFlag[id0[2]];
        ccDtDir.Add(direction, p);

        //C.3 Get Lines
        Line axis = new Line(polylines.First().First(), polylines.Last().Last());
        ccDtLines.Add(axis, p);

        //C.4 Get Average normal by summing mesh face planes
        Vector3d ZAxis = new Vector3d();

        foreach(string v in ccDt.Branch(p)  ) {
          int[] id = FEMaskE(v);//first segment
          ZAxis += planes[id[0]].ZAxis;
        }

        ccDtZAxis.Add(ZAxis, p);

        //C.5 Construct beam planes
        Plane axisPlane = new Plane(axis.PointAt(0.5), axis.Direction, ZAxis);
        Plane perpPlane = new Plane(axisPlane.Origin, ZAxis, axisPlane.ZAxis);



        //C.6 Append to Zollinger system
        ZollingerBeam zb = new ZollingerBeam(axisPlane, perpPlane, axis, direction, p.Indices[0]);
        ccZol.Add(zollinger.Count, p.Indices[0]);
        ccZol_.Add(p.Indices[0], zollinger.Count);
        zollinger.Add(zb);

      }



      //Change Zollinger planes by neighbour planes
      for(int i = 0; i < zollinger.Count; i++){
        GH_Path p = new GH_Path(zollinger.zb[i].id);
        //Rhino.RhinoApp.WriteLine();
        for(int j = 0; j < adjDt.Branch(p).Count; j++){

          //Get cp point


          int id_ = adjDt.Branch(p)[j];
          int id = ccZol_[id_];
          //Rhino.RhinoApp.WriteLine(zollinger.zb[i].id.ToString() + " " + id.ToString());
          zollinger.zb[i].neighbours.Add(id);
          double t0,t1;
          Rhino.Geometry.Intersect.Intersection.LineLine(zollinger.zb[i].axis, zollinger.zb[id].axis, out t0, out t1, 10000, false);

          if(t0 < 0.2){

            Point3d p0 = NGonsCore.PlaneUtil.LinePlane(zollinger.zb[i].axis, zollinger.zb[id].sidePlanes[1]);
            Point3d p1 = NGonsCore.PlaneUtil.LinePlane(zollinger.zb[i].axis, zollinger.zb[id].sidePlanes[3]);






            zollinger.zb[i].sidePlanes[0] = (p0.DistanceToSquared(zollinger.zb[i].c) < p1.DistanceToSquared(zollinger.zb[i].c)) ? zollinger.zb[id].sidePlanes[1] : zollinger.zb[id].sidePlanes[3];//zollinger.zb[id].axisPlane;
            zollinger.zb[i].sidePlanes[0].Origin = NGonsCore.PlaneUtil.LinePlane(zollinger.zb[i].axis, zollinger.zb[i].sidePlanes[0]);
          }else if(t0 > 0.8){

            Point3d p0 = NGonsCore.PlaneUtil.LinePlane(zollinger.zb[i].axis, zollinger.zb[id].sidePlanes[1]);
            Point3d p1 = NGonsCore.PlaneUtil.LinePlane(zollinger.zb[i].axis, zollinger.zb[id].sidePlanes[3]);



            zollinger.zb[i].sidePlanes[2] = (p0.DistanceToSquared(zollinger.zb[i].c) < p1.DistanceToSquared(zollinger.zb[i].c)) ? zollinger.zb[id].sidePlanes[1] : zollinger.zb[id].sidePlanes[3];//zollinger.zb[id].axisPlane;
            zollinger.zb[i].sidePlanes[2].Origin = NGonsCore.PlaneUtil.LinePlane(zollinger.zb[i].axis, zollinger.zb[i].sidePlanes[2]);


            zollinger.zb[i].sidePlanes[2].Origin = NGonsCore.PlaneUtil.LinePlane(zollinger.zb[i].axis, zollinger.zb[i].sidePlanes[2]);

            //            Plane plane = zollinger.zb[i].sidePlanes[2];
            //            plane.Origin = zollinger.zb[i].axis.PointAt(0.5);
            //             zollinger.zb[i].sidePlanes[2].Origin = NGonsCore.PlaneUtil.LinePlane(zollinger.zb[i].axis, zollinger.zb[i].sidePlanes[2]);

          }




        }

      }









      ccDtLines_ = ccDtLines;
      ccDtZAxis_ = ccDtZAxis;
      ccDtDir_ = ccDtDir;
      pipes_ = zollinger.GetAxes(0);
      pipesPl_ = zollinger.GetPerpPlanes();
      pipesAdj_ = zollinger.GetNeighbours();

      pipesDir_ = zollinger.GetDirections();
      if(RunPipes3d){
        pipes3d_ = zollinger.GetPipes();
      }
    }catch(Exception e) {
      Print(e.ToString());
    }
# ---------- c_script_3: C# additional code ----------
  public List<Polyline> AlignSegments (List<Polyline> plines, double tol = 0.10){
    List<Polyline> ordered = new List<Polyline>();

    if(plines.Count < 2)
      return plines;

    try{
      //Iterate polyline loop and flip segments, if needed

      //Check first / second segments
      Point3d pt0 = plines[0].First();
      Point3d pt1 = plines[0].Last();

      Point3d pt0Next = plines[1].First();
      Point3d pt1Next = plines[1].Last();

      if( (pt0.DistanceToSquared(pt0Next) < 0.01 || pt0.DistanceToSquared(pt1Next) < 0.01 )){

        ordered.Add(plines[0].Flip());
        pt0 = ordered[0].First();
        pt1 = ordered[0].Last();
      }else{
        ordered.Add(plines[0]);
      }

      //Iterate over all of plines


      for(int j = 1; j < plines.Count;j++){

        Point3d pt0Temp = plines[j].First();

        if(pt1.DistanceToSquared(pt0Temp) > 0.01){
          ordered.Add(plines[j].Flip());
        }else{
          ordered.Add(plines[j]);
        }

        pt0 = ordered[j].First();
        pt1 = ordered[j].Last();

      }
    }catch(Exception e){
      Rhino.RhinoApp.WriteLine(e.ToString());
    }
    return ordered;


  }


  public int[] FEMaskE(string s){
    var txt = s.Split(';');
    int f = Convert.ToInt32(txt[0]);
    int eMask = Convert.ToInt32(txt[1]);
    int e = Convert.ToInt32(txt[2]);
    return new int[]{f,eMask,e};
  }


  BoundingBox bbox;
  public Rhino.Display.Text3d[][] tDisplay;
  public Rhino.Display.Text3d[][] tDisplayEdges;
  public DataTree<Polyline> _tmap;

  public class Zollinger{

    public List<ZollingerBeam> zb = new List<ZollingerBeam>();

    public int Count
    {
      get { return zb.Count; }
      private set {  }  //center_ = value;
    }


    public Zollinger(){

    }

    public void Add(ZollingerBeam b){
      zb.Add(b);
    }

    public DataTree<Plane> GetSidePlanes(){
      var dt = new DataTree<Plane>();

      for(int i = 0; i < zb.Count;i++){
        dt.AddRange(zb[i].sidePlanes, new GH_Path(i));
      }

      return dt;
    }


    public DataTree<Line> GetAxes(double dist = 0){

      var dt = new DataTree<Line>();

      for(int i = 0; i < zb.Count;i++){

        Line line = zb[i].axis;
        Vector3d v = zb[i].basePlane.ZAxis * dist;
        line.Transform(Transform.Translation(v));

        dt.Add(line, new GH_Path(i));

      }

      return dt;
    }

    public DataTree<Plane> GetPerpPlanes(){
      var dt = new DataTree<Plane>();

      for(int i = 0; i < zb.Count;i++){
        dt.Add(zb[i].perpPlane, new GH_Path(i));
      }

      return dt;
    }

    public DataTree<Plane> GetAxisPlanes(){
      var dt = new DataTree<Plane>();

      for(int i = 0; i < zb.Count;i++){
        dt.Add(zb[i].axisPlane, new GH_Path(i));
      }

      return dt;
    }

    public DataTree<Plane> GetBasePlanes(){
      var dt = new DataTree<Plane>();

      for(int i = 0; i < zb.Count;i++){
        dt.Add(zb[i].basePlane, new GH_Path(i));
      }

      return dt;
    }

    public DataTree<Plane> GetTopBottomPlanes(){
      var dt = new DataTree<Plane>();

      for(int i = 0; i < zb.Count;i++){
        dt.AddRange(zb[i].topbotPlanes, new GH_Path(i));
      }

      return dt;
    }

    public DataTree<bool> GetDirections(){
      var dt = new DataTree<bool>();

      for(int i = 0; i < zb.Count;i++){
        dt.Add(zb[i].dir, new GH_Path(i));
      }

      return dt;
    }

    public DataTree<Polyline> GetOutlines(){
      var dt = new DataTree<Polyline>();

      for(int i = 0; i < zb.Count;i++){
        Polyline pl0 = NGonsCore.PolylineUtil.PolylineFromPlanes(zb[i].topbotPlanes[0], zb[i].sidePlanes.ToList(), true);
        Polyline pl1 = NGonsCore.PolylineUtil.PolylineFromPlanes(zb[i].topbotPlanes[1], zb[i].sidePlanes.ToList(), true);
        dt.Add(pl0, new GH_Path(i));
        dt.Add(pl1, new GH_Path(i));
      }

      return dt;
    }

    public DataTree<int> GetNeighbours(){
      var dt = new DataTree<int>();

      for(int i = 0; i < zb.Count;i++){
        dt.AddRange(zb[i].neighbours, new GH_Path(i));
      }

      return dt;
    }

    public DataTree< Curve> GetPipes(){
      var dt = new DataTree<Curve>();

      for(int i = 0; i < zb.Count;i++){

        Line line = new Line(zb[i].axis.From, zb[i].axis.To);
        line.Transform(Transform.Scale(zb[i].c, 2));
        Brep b = Rhino.Geometry.Brep.CreatePipe(line.ToNurbsCurve(), zb[i].r, false, PipeCapMode.None, false, 0.01, 0.01)[0];

        Curve[] crvs;
        Point3d[] pts;
        Rhino.Geometry.Intersect.Intersection.BrepPlane(b, zb[i].sidePlanes[0], 0.01, out crvs, out pts);
        Curve c0 = crvs[0].DuplicateCurve();
        Rhino.Geometry.Intersect.Intersection.BrepPlane(b, zb[i].sidePlanes[2], 0.01, out crvs, out pts);
        Curve c1 = crvs[0].DuplicateCurve();
        c1 = NGonsCore.CurveUtil.GuideCurveDirection(c0, c1);


        //
        //        Polyline pl0 = NGonsCore.PolylineUtil.PolylineFromPlanes(zb[i].topbotPlanes[0], zb[i].sidePlanes.ToList(), true);
        //        Polyline pl1 = NGonsCore.PolylineUtil.PolylineFromPlanes(zb[i].topbotPlanes[1], zb[i].sidePlanes.ToList(), true);
        dt.Add(c0, new GH_Path(i));
        dt.Add(c1, new GH_Path(i));
      }

      return dt;
    }






  }

  public class ZollingerBeam {

    public int id = 0;
    public Plane axisPlane = new Plane();
    public Plane perpPlane = new Plane();
    public Line axis = Line.Unset;
    public Plane[] sidePlanes = new Plane[4];

    public Plane basePlane = new Plane();
    public Plane[] topbotPlanes = new Plane[2];
    public List<int> neighbours = new List<int>();

    public bool dir = false;


    public double r = 90;

    //private Point3d center_;
    public Point3d c
    {
      get { return axis.PointAt(0.5); }
      private set {  }  //center_ = value;



    }

    public ZollingerBeam(Plane axisPlane, Plane perpPlane, Line axis, bool dir, int id){
      this.axisPlane = axisPlane;
      this.perpPlane = perpPlane;
      this.axis = axis;
      this.dir = dir;
      this.id = id;

      sidePlanes[0] = perpPlane.ChangeOrigin(axis.From);
      sidePlanes[1] = axisPlane.MovePlanebyAxis(r);
      sidePlanes[2] = perpPlane.ChangeOrigin(axis.To);
      sidePlanes[3] = axisPlane.MovePlanebyAxis(-r);

      basePlane = new Plane(axisPlane.Origin, axisPlane.XAxis, axisPlane.ZAxis);
      topbotPlanes[0] = basePlane.MovePlanebyAxis(r);
      topbotPlanes[1] = basePlane.MovePlanebyAxis(-r);

    }

  }


  public void GetDisplay(int f, Polyline pline, Plane plane, Tile2D t, int eCount){
    Polyline scalePline = pline.Duplicate();
    scalePline.Transform(Transform.Scale(plane.Origin, 0.65));
    Rhino.Display.Text3d[] txt = new Rhino.Display.Text3d[pline.SegmentCount];
    Rhino.Display.Text3d[] txtEdges = new Rhino.Display.Text3d[pline.SegmentCount];

    for(int i = 0; i < pline.SegmentCount; i++){
      Plane textPlane = new Plane(plane);
      textPlane.Origin = scalePline.PointAt(i + 0.5);
      textPlane.Flip();
      textPlane.Rotate(Math.PI, textPlane.ZAxis);
      Rhino.Display.Text3d entity = new Rhino.Display.Text3d((eCount + i).ToString(), new Plane(textPlane), 30);

      if(    t.geo[i].Count > 0){
        textPlane.Origin = t.geo[i][0].PointAt(0.5);
        string LineText = f.ToString() + ";" + t.e[i].ToString() + ";" + i.ToString();
        //Rhino.Display.Text3d entityEdge = new Rhino.Display.Text3d((eCount + i).ToString(), textPlane, 200);
        Rhino.Display.Text3d entityEdge = new Rhino.Display.Text3d(LineText, textPlane, 30);
        txtEdges[i] = entityEdge;
      }

      txt[i] = entity;

    }

    tDisplay[f] = txt;
    tDisplayEdges[f] = txtEdges;

  }



  public  int[] CommonEdge(Mesh M, int F0, int F1) {

    int[] e0 = M._fe(F0);
    int[] e1 = M._fe(F1);


    var common = e0.Intersect(e1);

    if (common.Count() > 0){

      int commonEdge = common.First();

      int a = 0;
      int b = 0;

      for(int i = 0; i < e0.Length; i++){
        if(commonEdge == e0[i]){
          a = i;
          break;
        }
      }

      for(int i = 0; i < e1.Length; i++){
        if(commonEdge == e1[i]){
          b = i;
          break;
        }
      }

      return new int[]{a,b};


    }else
      return new int[]{-1,-1};
  }


  //Return a BoundingBox that contains all the geometry you are about to draw.
  public override BoundingBox ClippingBox
  {
    get
    {
      return bbox;
    }
  }

  //Draw all meshes in this method.
  public override void DrawViewportMeshes(IGH_PreviewArgs args)
  {
  }

  //Draw all wires and points in this method.
  public override void DrawViewportWires(IGH_PreviewArgs args)
  {
    //
    //    foreach(var l in this._tmap.AllData()){
    //      args.Display.DrawArrow(new Line(l[0], l[l.Count - 1]), System.Drawing.Color.Black);
    //    }


    foreach(var array in tDisplay){
      if(array != null){
        foreach(var element in array){
          args.Display.Draw3dText(element, System.Drawing.Color.Black);
        }
      }
    }

    foreach(var array in tDisplayEdges){
      if(array != null){
        foreach(var element in array){
          if(element != null){
            args.Display.Draw3dText(element, System.Drawing.Color.OrangeRed);
          }
        }
      }
    }

  }
# ---------- end c_script_3 ----------

# ---- group: Volumes
number_slider_19 = Slider(1, range=0..10)  # disabled
number_slider_20 = Slider(150, range=0..1000)  # disabled
swatch = ColourSwatch(SwatchColor=RGB(255, 255, 255))  # disabled
swatch_2 = ColourSwatch(SwatchColor=RGB(255, 182, 133))  # disabled
loft_2 = Loft(
    Curves=c_script_3.pipes3d,
    Options={Adjust=False, Closed=False, LoftEnds=0, LoftSimp=0, LoftType=0, Rebuild=10, Refit=0.01})  # disabled
series = Series(Start=0, Step=number_slider_20, Count=number_slider_19)  # disabled
amp = Amplitude(Vector=c_script_3.ccDtZAxis, Amplitude=series)  # -> simplify(Vector); disabled
item_2 = ListItem(List=[swatch, swatch_2], Index=c_script_3.pipesDir, Wrap=True)  # disabled
cap = CapHoles(Brep=loft_2)  # disabled
move = Move(Geometry=cap, Motion=amp)  # -> Geometry, Transform; disabled
material = Material(C=item_2)  # -> out, M; inputs C: Color, R: Double, S: Double, T: Double; disabled
# ---------- material: C# usings ----------
using System.IO;
using System.Linq;
using System.Data;
using System.Drawing;
using System.Reflection;
using System.Windows.Forms;
using System.Xml;
using System.Xml.Linq;
using System.Runtime.InteropServices;

using Rhino.DocObjects;
using Rhino.Collections;
using GH_IO;
using GH_IO.Serialization;
# ---------- material: C# ----------
    Color c = (C == Color.Empty) ? Color.FromArgb(135, 135, 135) : C;
    double r = ( this.Component.Params.Input[1].SourceCount == 0) ? 0.904 : R;
    double s = ( this.Component.Params.Input[2].SourceCount == 0) ? 0.49 : S;
    double t = (this.Component.Params.Input[3].SourceCount == 0) ? 0.0 : T;
 

    r = Math.Min(Math.Max(r, 0), 1);
    s = Math.Min(Math.Max(s, 0), 1);

    Material material = new Material();
    material.ReflectionColor = c;
    material.DiffuseColor = Color.White;
    material.AmbientColor = Color.Black;
    material.EmissionColor = Color.Black;
    material.Reflectivity = r;
    material.ReflectionGlossiness = s;
    material.Transparency = t;

    var renderMaterial = Rhino.Render.RenderMaterial.CreateBasicMaterial(material);
    M = new GH_Material(renderMaterial);
# ---------- end material ----------
mesh_4 = Mesh(move.Geometry)  # disabled
preview = CustomPreview(Geometry=flatten(mesh_4), Material=flatten(material.M))  # disabled

# ---- group: Adjacency
crv_6 = Curve(reparameterize(c_script_3.pipes))
branch_3 = TreeBranch(Tree=crv_6, Path="100", MaintainPaths=True)
branch_4 = TreeBranch(Tree=c_script_3.pipesAdj, Path="100", MaintainPaths=True)
branch_5 = TreeBranch(Tree=crv_6, Path=branch_4, MaintainPaths=True)
display = CurvePreview(Curve=branch_3, Width=10, Colour=RGB(255, 208, 0))
display_2 = CurvePreview(Curve=branch_5, Width=10, Colour=RGB(0, 0, 0))
display_3 = CurvePreview(Curve=crv_6, Width=2, Colour=RGB(0, 0, 0))

# ---- group: For Joinery Solver
c_script_4 = CSharpScript(L=flatten(crv_6), N=c_script_3.pipesAdj, MaxDist="20360")  # -> out, A, B; inputs L: list of Line, N: tree of Int32, MaxDist: Double
# ---------- c_script_4: C# ----------
    List<Line> LCopy = new List<Line>(L);
    List<List<double>> LineParameters = new List<List<double>>(L.Count);
    for(int i = 0; i < L.Count; i++){
      LineParameters.Add(new List<double>());
    }




    DataTree < Line > connections = new DataTree<Line>();

    for(int i = 0; i < N.BranchCount; i++){
      Line l0 = L[i];
      for(int j = 0; j < N.Branch(i).Count; j++){

        Line l1 = L[N.Branch(i)[j]];

        double t0, t1;

        Rhino.Geometry.Intersect.Intersection.LineLine(l0, l1, out t0, out t1, 1000, false);
        Point3d p0 = l0.PointAt(t0);
        Point3d p1 = l1.PointAt(t1);

        if(p0.DistanceTo(p1) < MaxDist){

          LineParameters[i].Add(t0);
          LineParameters[N.Branch(i)[j]].Add(t1);


          connections.Add(new Line(l0.PointAt(t0), l1.PointAt(t1)), new GH_Path(i));
        }




      }

    }


    for(int i = 0; i < LineParameters.Count; i++){
      
      double[] t = LineParameters[i].ToArray();
      Array.Sort(t);
      
      if(t.Length > 0){
      
        List < double > tClean = new List<double>(LineParameters[i].Count){t[0]};
        
        for (int j = 1; j < t.Length; j++)
          if(Math.Abs(tClean[tClean.Count - 1] - t[j]) > 0.01 )
            tClean.Add(t[j]);
        
        Print(tClean.Count.ToString());
        
          
   
      

      
        if(tClean.Count == 1){
          //Print("hi");
          
          if( Math.Abs(t[0] - 0) > Math.Abs(t[0] - 1) ){
            LCopy[i] = new Line( LCopy[i].PointAt(0),LCopy[i].PointAt(t[0]));
          }else{
            LCopy[i] = new Line(LCopy[i].PointAt(t[0]), LCopy[i].PointAt(1));
          }
        
        }else {
          LCopy[i] = new Line(LCopy[i].PointAt(tClean[0]), LCopy[i].PointAt(tClean[tClean.Count - 1]));
        }
        
      }//more than 1
      
    }//for i


    A = connections;
    B = LCopy;
# ---------- end c_script_4 ----------

# ----
# Mesh Input
crv_7 = Curve(Tree({0;0;0;0;0}: [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], {0;1;0;0;0}: [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], {0;2;0;0;0}: [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]))  # disabled
# Translation
people = Mesh([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])  # disabled
pt = Point(Point(10.90877726, -14.29412469, 0))  # disabled
number_slider_21 = Slider(1, range=0..1)  # disabled
number_slider_22 = Slider(0, range=0..1)  # disabled
mesh_5 = Mesh(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)  # disabled
mesh_6 = Mesh(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)  # disabled
mesh_7 = Mesh(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)  # disabled
mesh_8 = Mesh(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)  # disabled
mesh_9 = Mesh(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)  # disabled
number_slider_23 = Slider(0.2, range=0..1)  # disabled
scale = Scale(Geometry=mesh_6, Center=pt, Factor=number_slider_21)  # -> Geometry, Transform; disabled
meshprop = MeshProp(Mesh=scale.Geometry, Offset=0, Flip=invert(False))  # -> MeshProperties, FacePlanes, FaceEdgePlanes, EdgePlanes, Mesh; disabled
meshprop_2 = MeshProp(Mesh=scale.Geometry, Offset=number_slider_23, Flip=False)  # -> MeshProperties, FacePlanes, FaceEdgePlanes, EdgePlanes, Mesh; disabled

# ----
# Mesh Input
crv_8 = Curve(Tree({0;0;0;0;0}: [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], {0;1;0;0;0}: [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], {0;2;0;0;0}: [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]))  # disabled
pt_2 = Point(Point(10.90877726, -14.29412469, 0))  # disabled
number_slider_24 = Slider(1, range=0..1)  # disabled
# Translation
people_2 = Mesh([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])  # disabled
number_slider_25 = Slider(0, range=0..1)  # disabled
mesh_10 = Mesh(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)  # disabled
mesh_11 = Mesh(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)  # disabled
mesh_12 = Mesh(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)  # disabled
mesh_13 = Mesh(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)  # disabled
mesh_14 = Mesh(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)  # disabled
number_slider_26 = Slider(0.2, range=0..1)  # disabled
scale_2 = Scale(Geometry=mesh_14, Center=pt_2, Factor=number_slider_24)  # -> Geometry, Transform; disabled
meshprop_3 = MeshProp(Mesh=scale_2.Geometry, Offset=0, Flip=invert(False))  # -> MeshProperties, FacePlanes, FaceEdgePlanes, EdgePlanes, Mesh; disabled
meshprop_4 = MeshProp(Mesh=scale_2.Geometry, Offset=number_slider_26, Flip=False)  # -> MeshProperties, FacePlanes, FaceEdgePlanes, EdgePlanes, Mesh; disabled

number_slider_27 = Slider(12, range=0..40)  # disabled
number_slider_28 = Slider(6, range=0..10)  # disabled
brep_5 = Brep(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)  # disabled
quaddivide = QuadDivide(Surface=brep_5, U=number_slider_28, V=number_slider_27, Rebuild=-1, Divisions=True, Explode=False)  # disabled
meshprop_5 = MeshProp(Mesh=quaddivide, Offset=0, Flip=False)  # -> MeshProperties, FacePlanes, FaceEdgePlanes, EdgePlanes, Mesh; disabled
number_slider_29 = Slider(0.88, range=0..30.01)  # disabled
top_5 = GetPolylines(Mesh=quaddivide)  # disabled
fromp_5 = FromPolylines(Curves=top_5, Min_Triangulation=True)  # disabled
recimove = ReciMove(MeshProp=meshprop_5.MeshProperties, Dist=number_slider_29)  # -> Lines, Ecc, Nexors, MeshProp, LinesN; disabled
recitran = ReciTran(
    M=fromp_5,
    D=number_slider_29,
    Reference=["C:\Users\petra\AppData\Roaming\Grasshopper\6\Libraries\Ngons\Math\MathNet.Numerics.dll", "C:\Users\petra\AppData\Roaming\Grasshopper\6\Libraries\Ngons\NGonsCore.dll"])  # -> out, Colors, EdgeOutlines, EdgeLines, Eccentricities; inputs M: Mesh, D: Double; disabled
# ---------- recitran: C# usings ----------
using NGonsCore;
using Algo;
using Advanced.Algorithms.Graph;
# ---------- recitran: C# ----------
    //Trasnlate facelines by colored graph
    Line[][] EFLines = M._EFLines();
    Dictionary<int,int> edgeColors = M._GraphColorHalfEdgesDict();
    int[][] FEFlatten = M._FEFlatten();
    TranslateLines(ref EFLines, M, edgeColors, FEFlatten, D, D < 0);

    //Create Nexors
    Nexor[][] nexors = new Nexor[M._countF()][];
    for(int i = 0; i < M._countF(); i++){
      nexors[i] = new Nexor[M._countE(i)];
      for(int j = 0; j < M._countE(i); j++)
        nexors[i][j] = new Nexor(EFLines[i][j]);
    }



    //Intersect lines to get good end points, StartPoint = Prev+Opposite Line, EndPoint = Next+Opposite Line
    //Eccentricities?



    for(int i = 0; i < M._countF(); i++){




      for(int j = 0; j < M._countE(i); j++){

        int id = FEFlatten[i][j];

        if(edgeColors[id] == 0){

          Line line = EFLines[i][j];



          int[] NextOppo = M._OppositeFE(i, (j + 1).Wrap(M._countE(i)));
          Line lineNextOppo = (NextOppo[0] != -1 ) ? EFLines[NextOppo[0]][NextOppo[1]] : EFLines[i].next(j);
          Line cpNext = line.LineLineCP(lineNextOppo);
          EFLines[i][j] = new Line(EFLines[i][j].From, cpNext.From);

          int[] PrevOppo = M._OppositeFE(i, (j - 1).Wrap(M._countE(i)));
          Line linePrevOppo = (PrevOppo[0] != -1 ) ? EFLines[PrevOppo[0]][PrevOppo[1]] : EFLines[i].prev(j);
          Line cpPrev = line.LineLineCP(linePrevOppo);
          EFLines[i][j] = new Line(cpPrev.From, EFLines[i][j].To);

          //Nexor properties
          nexors[i][j].isNexor = true;
          nexors[i][j].eccentricities.Add(cpNext);
          nexors[i][j].eccentricities.Add(cpPrev);
          nexors[i][j].line = EFLines[i][j];
        }

      }

    }




    Colors = M._GraphColorHalfEdges();
    EdgeOutlines = M._EFPolylinesAll();
    EdgeLines = GetNexorLines(nexors);
    Eccentricities = GetNexorEccentricities(nexors);
# ---------- recitran: C# additional code ----------
  public List<Line> GetNexorLines(Nexor[][] nexors){
    List<Line> lines = new List<Line>();

    foreach(var nn in nexors)
      foreach(var n in nn)
        if(n.isNexor)
          lines.Add(n.line);
    return lines;
  }


  public List<Line> GetNexorEccentricities(Nexor[][] nexors){
    List<Line> lines = new List<Line>();

    foreach(var nn in nexors)
      foreach(var n in nn)
        if(n.isNexor)
          lines.AddRange(n.eccentricities);
    return lines;
  }

  public class Nexor{

    public Line line = new Line();
    public List<Line> eccentricities = new List<Line>();
    public bool isNexor = false;

    public Nexor(Line line){
      this.line = line;
    }

  }

  public void TranslateLines(ref Line[][] EFLines, Mesh M,  Dictionary<int,int> edgeColors, int[][] FEFlatten, double D = 0.01,bool scale = false ){

    //Translate lines
    for(int i = 0; i < M._countF(); i++){

      Point3d c = M._FCenter(i);

      for(int j = 0; j < FEFlatten[i].Length;j++){

        Vector3d v0 = EFLines[i].next(j).Direction.UnitVector();
        Vector3d v1 = -EFLines[i].prev(j).Direction.UnitVector();
        Vector3d v = (v0 + v1) * 0.5;


        int id = FEFlatten[i][j];

        if(edgeColors[id] == 0){
          if(scale)
            EFLines[i][j].Transform(Transform.Scale(c, Math.Abs(D)));
          else
            EFLines[i][j].Transform(Transform.Translation(v * D));

        }


      }

    }


  }
# ---------- end recitran ----------
linedisplay = LineDisplay(y=0.035)  # disabled
crv_9 = Curve(recitran.EdgeLines)  # disabled

# ----
# Nexorade
number_slider_30 = Slider(0.1, range=0..0.2)  # disabled
recimove_2 = ReciMove(MeshProp=meshprop_2.MeshProperties, Dist=number_slider_30)  # -> Lines, Ecc, Nexors, MeshProp, LinesN; disabled
recimove_3 = ReciMove(MeshProp=meshprop.MeshProperties, Dist=number_slider_30)  # -> Lines, Ecc, Nexors, MeshProp, LinesN; disabled

# ----
# Nexorade
number_slider_31 = Slider(0.1, range=0..0.2)  # disabled
recimove_4 = ReciMove(MeshProp=meshprop_4.MeshProperties, Dist=number_slider_31)  # -> Lines, Ecc, Nexors, MeshProp, LinesN; disabled
recimove_5 = ReciMove(MeshProp=meshprop_3.MeshProperties, Dist=number_slider_31)  # -> Lines, Ecc, Nexors, MeshProp, LinesN; disabled

crv_10 = Curve(recimove_3.Lines)  # disabled
item_3 = ListItem(List=crv_10, Index=0, Wrap=True)  # -> Item, Item1; disabled
crv_11 = Curve(flatten(recimove_3.LinesN))  # disabled
crv_12 = Curve(flatten(recimove_3.Lines))  # disabled
crv_13 = Curve(flatten(recimove_3.Ecc))  # disabled
end = EndPoints(Curve=crv_13)  # -> Start, End; disabled
end_2 = EndPoints(Curve=item_3.Item)  # -> Start, End; disabled
end_3 = EndPoints(Curve=item_3.Item1)  # -> Start, End; disabled
ln = Line(StartPoint=end_2.Start, EndPoint=end_3.Start)  # -> flatten(Line); disabled
ln_2 = Line(StartPoint=end_2.End, EndPoint=end_3.End)  # -> flatten(Line); disabled
crv_14 = Curve([crv_13, crv_11, crv_12, ln, ln_2])  # disabled
curveshatter = CurveShatter(Curve=crv_14, Points=[end.Start, end.End], Tolerance=0.01)  # -> flatten(Curves); disabled
number_slider_32 = Slider(0.0051, range=0..1)  # disabled
clean = CleanTree(RemoveNulls=True, RemoveInvalid=True, RemoveEmpty=invert(False), Tree=curveshatter)  # disabled
curveends = CurveEnds(Curves=flatten(clean), Tolerance=number_slider_32)  # disabled
curvepoint = PointOnCurve([ln, ln_2], parameter=0.5)  # disabled
clean_2 = CleanTree(RemoveNulls=True, RemoveInvalid=True, RemoveEmpty=invert(False), Tree=curveends)  # disabled
curvepoint_2 = PointOnCurve(clean_2, parameter=0.5)  # disabled
cp = ClosestPoint(Point=curvepoint, Cloud=curvepoint_2)  # -> ClosestPoint, CPIndex, Distance; disabled
cull_i = CullIndex(List=clean_2, Indices=cp.CPIndex, Wrap=True)  # disabled
item_4 = ListItem(List=clean_2, Index=cp.CPIndex, Wrap=True)  # disabled

# ----
# Rotate Mesh edge according to average Normal
# And cut end parts - Rectangle Sections
number_slider_33 = Slider(10, range=0..10)  # disabled
number_slider_34 = Slider(9, range=0..10)  # disabled
brep_6 = Brep(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)  # disabled
hexdivide_4 = HexDivide(
    Surface=brep_6,
    U=number_slider_33,
    V=number_slider_34,
    Parameter=0.25,
    Boundary=0,
    Swap=True,
    Rebuild=9,
    Quadrangulate=False,
    Divisions=False,
    Explode=True)  # -> Mesh, DistA, DistB; disabled
number_slider_35 = Slider(0.21, range=0..1)  # disabled
top_6 = GetPolylines(Mesh=hexdivide_4.Mesh)  # disabled
number_slider_36 = Slider(0.525, range=0..1)  # disabled
fromp_6 = FromPolylines(Curves=top_6, Min_Triangulation=False)  # disabled
recipricalextend_2 = RecipricalExtend(Mesh=fromp_6, Angle=number_slider_35, Scale=1.4, NormalType=True, Height=1)  # -> graft(CM), C0, C1, P, EP; disabled
edges = NGonEdges(Mesh=fromp_6)  # -> Edges, ID, NakedID, Normal, Naked, AllE; disabled
not = GateNot(A=edges.NakedID)  # disabled

graft = GraftTree(Tree=recipricalextend_2.EP, IncludeEmptyLists=True, IncludeNullItems=True)  # disabled
neg = Negative(Value=number_slider_36)  # disabled
deplane = DeconstructPlane(Plane=graft)  # -> Origin, XAxis, YAxis, ZAxis; disabled
pline = PolyLine(Vertices=recipricalextend_2.EP, Closed=False)  # disabled
amp_2 = Amplitude(Vector=deplane.ZAxis, Amplitude=[number_slider_36, neg])  # disabled
curvepoint_3 = PointOnCurve(pline, parameter=0.5)  # disabled
move_2 = Move(Geometry=graft(graft), Motion=amp_2)  # -> simplify(Geometry), Transform; disabled
dup = DuplicateData(Data=curvepoint_3, Number=2, Order=True)  # -> simplify(graft(Data)); disabled
dom = ConstructDomain(DomainStart=expr("-X", number_slider_36), DomainEnd=number_slider_36)  # disabled
dist = Distance(PointA=dup, PointB=move_2.Geometry)  # disabled
sort = SortList(Keys=dist, ValuesA=move_2.Geometry)  # -> Keys, ValuesA; disabled
item_5 = ListItem(List=sort.ValuesA, Index=0, Wrap=True)  # disabled
trim_2 = TrimTree(Tree=item_5, Depth=1)  # disabled
item_6 = ListItem(List=trim_2, Index=0, Wrap=True)  # -> Item, Item1; disabled
project = Project(Geometry=item_6.Item, Plane=item_6.Item1)  # -> Geometry, Transform; disabled
merge = Merge(Data1=project.Geometry, Data2=item_6.Item)  # disabled

ext = ExtendCurve(Curve=recipricalextend_2.CM, Type=0, Start=1, End=1)  # disabled
deplane_2 = DeconstructPlane(Plane=graft(recipricalextend_2.P))  # -> Origin, XAxis, YAxis, ZAxis; disabled
end_4 = EndPoints(Curve=ext)  # -> Start, End; disabled
pl = ConstructPlane(Origin=[end_4.Start, end_4.End], XAxis=deplane_2.YAxis, YAxis=deplane_2.ZAxis)  # disabled
item_7 = ListItem(List=pl, Index=0, Wrap=True)  # -> Item, Item1; disabled
project_2 = Project(Geometry=item_7.Item, Plane=item_7.Item1)  # -> Geometry, Transform; disabled
merge_2 = Merge(Data1=project_2.Geometry, Data2=item_7.Item)  # disabled
rectangle = Rectangle(Plane=merge_2, XSize=dom, YSize=dom, Radius=0)  # -> Rectangle, Length; disabled
loft_3 = LoftPolylines(Curve0=rectangle.Rectangle, Fast=invert(True))  # disabled
sec = MeshPlane(Mesh=loft_3, Plane=merge)  # disabled

trim_3 = TrimTree(Tree=sec, Depth=1)  # disabled
item_8 = ListItem(List=trim_3, Index=0, Wrap=True)  # -> Item, Item1; disabled
loft_4 = LoftPolylines(Curve0=item_8.Item, Curve1=item_8.Item1, Fast=invert(True))  # disabled
mesh_15 = Mesh(loft_4)  # disabled
cull = CullPattern(List=flatten(mesh_15), CullPattern=not)  # disabled

# ----
# Mesh Input
people_3 = Mesh([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])  # disabled
pt_3 = Point(Point(10.90877726, -14.29412469, 0))  # disabled
number_slider_37 = Slider(0.6, range=0..1)  # disabled
number_slider_38 = Slider(0, range=0..1)  # disabled
number_slider_39 = Slider(0.2, range=0..1)  # disabled

# ----
# Translation Volume + Panels
mesh_16 = Mesh(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)  # disabled
mesh_17 = Mesh()  # disabled

scale_3 = Scale(Geometry=mesh_16, Center=pt_3, Factor=number_slider_37)  # -> Geometry, Transform; disabled
meshprop_6 = MeshProp(Mesh=scale_3.Geometry, Offset=0, Flip=invert(False))  # -> MeshProperties, FacePlanes, FaceEdgePlanes, EdgePlanes, Mesh; disabled
meshprop_7 = MeshProp(Mesh=scale_3.Geometry, Offset=number_slider_39, Flip=False)  # -> MeshProperties, FacePlanes, FaceEdgePlanes, EdgePlanes, Mesh; disabled

# ----
# Nexorade
number_slider_40 = Slider(0.1, range=0..0.2)  # disabled
recimove_6 = ReciMove(MeshProp=meshprop_7.MeshProperties, Dist=number_slider_40)  # -> Lines, Ecc, Nexors, MeshProp, LinesN; disabled
recimove_7 = ReciMove(MeshProp=meshprop_6.MeshProperties, Dist=number_slider_40)  # -> Lines, Ecc, Nexors, MeshProp, LinesN; disabled

recimovevol = ReciMoveVol(Nexors0=recimove_7.Nexors, MeshProp0=recimove_7.MeshProp, Nexors1=recimove_6.Nexors, MeshProp1=recimove_6.MeshProp)  # -> Beams0, Panels0, RoundBeams0M, RoundBeams0C, RoundBeams0C_2, Beams1, Panels1, RoundBeams1M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; disabled
brep_7 = Brep(recimovevol.RoundBeams1M)  # disabled

# ----
# Preview
partition = PartitionList(List=[recimovevol.Beams0, recimovevol.Beams1], Size=2)  # -> reverse(Chunks); disabled
loft_5 = LoftPolylines(Curve0=flatten([recimovevol.Panels0, recimovevol.Panels1]), Fast=invert(True))  # disabled
loft_6 = LoftPolylines(Curve0=partition, Fast=invert(True))  # -> simplify(Mesh); disabled
ngonpreview = NGonPreview(Mesh=loft_5, Front=RGB(240, 240, 240), Back=RGB(240, 240, 240))  # disabled
trim_4 = TrimTree(Tree=loft_6, Depth=2)  # disabled
pr = DTPreview(O=trim_4)  # disabled

# ----
# Mesh Input
people_4 = Mesh([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])  # disabled
pt_4 = Point(Point(10.90877726, -14.29412469, 0))  # disabled
number_slider_41 = Slider(0.6, range=0..1)  # disabled
number_slider_42 = Slider(0, range=0..1)  # disabled
number_slider_43 = Slider(0.2, range=0..1)  # disabled

# ----
# Translation Volume + Panels
mesh_18 = Mesh(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)  # disabled

scale_4 = Scale(Geometry=mesh_18, Center=pt_4, Factor=number_slider_41)  # -> Geometry, Transform; disabled
meshprop_8 = MeshProp(Mesh=scale_4.Geometry, Offset=0, Flip=invert(False))  # -> MeshProperties, FacePlanes, FaceEdgePlanes, EdgePlanes, Mesh; disabled
meshprop_9 = MeshProp(Mesh=scale_4.Geometry, Offset=number_slider_43, Flip=False)  # -> MeshProperties, FacePlanes, FaceEdgePlanes, EdgePlanes, Mesh; disabled

# ----
# Nexorade
number_slider_44 = Slider(0.1, range=0..0.2)  # disabled
recimove_8 = ReciMove(MeshProp=meshprop_9.MeshProperties, Dist=number_slider_44)  # -> Lines, Ecc, Nexors, MeshProp, LinesN; disabled
recimove_9 = ReciMove(MeshProp=meshprop_8.MeshProperties, Dist=number_slider_44)  # -> Lines, Ecc, Nexors, MeshProp, LinesN; disabled

recimovevol_2 = ReciMoveVol(Nexors0=recimove_9.Nexors, MeshProp0=recimove_9.MeshProp, Nexors1=recimove_8.Nexors, MeshProp1=recimove_8.MeshProp)  # -> Beams0, Panels0, RoundBeams0M, RoundBeams0C, RoundBeams0C_2, Beams1, Panels1, RoundBeams1M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; disabled
tstat = TreeStatistics(Tree=recimovevol_2.RoundBeams0M)  # -> Paths, Length, Count; disabled
tstat_2 = TreeStatistics(Tree=recimovevol_2.RoundBeams1M)  # -> Paths, Length, Count; disabled
brep_8 = Brep(recimovevol_2.RoundBeams1M)  # disabled

panel = Panel("""39;1
54;0
54;2
55;3
24;2""")  # disabled
data = Data(panel)  # disabled
branch_6 = TreeBranch(Tree=recimovevol_2.RoundBeams1M, Path=data, MaintainPaths=True)  # disabled
branch_7 = TreeBranch(Tree=recimovevol_2.RoundBeams1C, Path=data, MaintainPaths=True)  # disabled
branch_8 = TreeBranch(Tree=recimovevol_2.RoundBeams1C_2, Path=data, MaintainPaths=True)  # disabled
partition_2 = PartitionList(List=branch_7, Size=2)  # disabled
loft_7 = Loft(Curves=partition_2, Options={Adjust=False, Closed=False, LoftEnds=0, LoftSimp=0, LoftType=0, Rebuild=10, Refit=0.01})  # disabled
loft_8 = Loft(Curves=branch_8, Options={Adjust=False, Closed=False, LoftEnds=0, LoftSimp=0, LoftType=3, Rebuild=10, Refit=0.01})  # disabled
cap_2 = CapHoles(Brep=loft_7)  # disabled
cap_3 = CapHoles(Brep=loft_8)  # disabled
trim_5 = TrimTree(Tree=cap_2, Depth=1)  # disabled
clean_3 = CleanTree(RemoveNulls=True, RemoveInvalid=True, RemoveEmpty=False, Tree=cap_3)  # disabled
merge_3 = Merge(Data1=trim_5, Data2=clean_3)  # disabled
c_script_5 = CSharpScript(brep=branch_6, splitter=merge_3)  # -> out, A; inputs brep: Brep, splitter: list of Brep; disabled
# ---------- c_script_5: C# ----------
    // A = Brep.CreateBooleanDifference(brep, splitter[0], 0.01);

    Brep capped = brep.DuplicateBrep();


    for(int i = 0; i < splitter.Count; i++){
      Brep[] m = Brep.CreateBooleanDifference(capped, splitter[i], 0.00001);

      //  Print(m.Length.ToString());
      //
      //      if(i == 3){
      //        Rhino.RhinoDoc.ActiveDoc.Objects.AddMesh(capped);
      //        Rhino.RhinoDoc.ActiveDoc.Objects.AddMesh(m[0]);
      //        Rhino.RhinoDoc.ActiveDoc.Objects.AddMesh(splitter[i]);
      //      }

      double area = m[0].GetBoundingBox(false).Diagonal.Length;
      int id = 0;
      for(int j = 1; j < m.Length; j++){
        double area_ = m[j].GetBoundingBox(false).Diagonal.Length;

        if(area_ > area){
          id = j;
          area = area_;
        }
      }



      capped = m[id].DuplicateBrep();

    }


    A = capped;
# ---------- end c_script_5 ----------
edges_2 = BrepEdges(Brep=c_script_5.A)  # -> Naked, Interior, NonManifold; disabled
display_4 = CurvePreview(Curve=[edges_2.Naked, edges_2.Interior, edges_2.NonManifold], Width=2, Colour=RGB(0, 0, 0))  # disabled

panel_2 = Panel("""47;1
47;3""")  # disabled
data_2 = Data(tstat.Paths)  # disabled
branch_9 = TreeBranch(Tree=recimovevol_2.RoundBeams0M, Path=data_2, MaintainPaths=True)  # disabled
branch_10 = TreeBranch(Tree=recimovevol_2.RoundBeams0C_2, Path=data_2, MaintainPaths=True)  # disabled
branch_11 = TreeBranch(Tree=recimovevol_2.RoundBeams0C, Path=data_2, MaintainPaths=True)  # disabled
partition_3 = PartitionList(List=branch_11, Size=2)  # disabled
loft_9 = Loft(Curves=partition_3, Options={Adjust=False, Closed=False, LoftEnds=0, LoftSimp=0, LoftType=0, Rebuild=10, Refit=0.01})  # disabled
loft_10 = Loft(Curves=branch_10, Options={Adjust=False, Closed=False, LoftEnds=0, LoftSimp=0, LoftType=3, Rebuild=10, Refit=0.01})  # disabled
cap_4 = CapHoles(Brep=loft_9)  # disabled
cap_5 = CapHoles(Brep=loft_10)  # disabled
trim_6 = TrimTree(Tree=cap_4, Depth=1)  # disabled
clean_4 = CleanTree(RemoveNulls=True, RemoveInvalid=True, RemoveEmpty=False, Tree=cap_5)  # disabled
merge_4 = Merge(Data1=trim_6, Data2=clean_4)  # disabled
c_script_6 = CSharpScript(brep=branch_9, splitter=merge_4)  # -> out, A; inputs brep: Brep, splitter: list of Brep; disabled
# ---------- c_script_6: C# ----------
    // A = Brep.CreateBooleanDifference(brep, splitter[0], 0.01);

    Brep capped = brep.DuplicateBrep();


    for(int i = 0; i < splitter.Count; i++){
      Brep[] m = Brep.CreateBooleanDifference(capped, splitter[i], 0.0001);

      //  Print(m.Length.ToString());
      //
      //      if(i == 3){
      //        Rhino.RhinoDoc.ActiveDoc.Objects.AddMesh(capped);
      //        Rhino.RhinoDoc.ActiveDoc.Objects.AddMesh(m[0]);
      //        Rhino.RhinoDoc.ActiveDoc.Objects.AddMesh(splitter[i]);
      //      }

      double area = m[0].GetBoundingBox(false).Diagonal.Length;
      int id = 0;
      for(int j = 1; j < m.Length; j++){
        double area_ = m[j].GetBoundingBox(false).Diagonal.Length;

        if(area_ > area){
          id = j;
          area = area_;
        }
      }



      capped = m[id].DuplicateBrep();

    }


    A = capped;
# ---------- end c_script_6 ----------
edges_3 = BrepEdges(Brep=c_script_6.A)  # -> Naked, Interior, NonManifold; disabled
display_5 = CurvePreview(Curve=[edges_3.Naked, edges_3.Interior, edges_3.NonManifold], Width=2, Colour=RGB(0, 0, 0))  # disabled

# ----
# Preview
partition_4 = PartitionList(List=[recimovevol_2.Beams0, recimovevol_2.Beams1], Size=2)  # -> reverse(Chunks); disabled
loft_11 = LoftPolylines(Curve0=flatten([recimovevol_2.Panels0, recimovevol_2.Panels1]), Fast=invert(True))  # disabled
loft_12 = LoftPolylines(Curve0=partition_4, Fast=invert(True))  # -> simplify(Mesh); disabled
ngonpreview_2 = NGonPreview(Mesh=loft_11, Front=RGB(240, 240, 240), Back=RGB(240, 240, 240))  # disabled
trim_7 = TrimTree(Tree=loft_12, Depth=2)  # disabled
pr_2 = DTPreview(O=trim_7)  # disabled

pr_3 = DTPreview(O=[c_script_5.A, c_script_6.A])  # disabled

# ==== cluster DTPreview: DTPreview
O = ClusterInput()
group = Group(Objects=O)
tstat = TreeStatistics(Tree=group)  # -> Paths, Length, Count
jitter = Jitter(List=flatten(group), Jitter=1, Seed=2)  # -> Values, Indices
range = Range(Domain=Domain(0, 1), Steps=tstat.Count)
gradient = Gradient(LowerLimit=0, UpperLimit=1, Parameter=range, stops=[0: RGB(120, 102, 79), 1: RGB(214, 207, 176)])
preview = CustomPreview(Geometry=jitter.Values, Material=flatten(gradient))

# ==== cluster LineDisplay: Compate Line Lengths
x = ClusterInput()
y = ClusterInput()
c_script = CSharpScript(x=x, y=y)  # -> out, M, p, l, min, max, A; inputs x: list of Line, y: Double
# ---------- c_script: C# usings ----------
using System.Linq;
# ---------- c_script: C# ----------
    Mesh mesh = Mesh.CreateFromPlane(Plane.WorldXY, new Interval(0, 60), new Interval(0, 550), 1, 10);
    M = mesh;
    List<Point3d> pts = new List<Point3d>();
    List<double> len = new List<double>();

    for(int i = 0;i < x.Count;i++){
      pts.Add(x[i].PointAt(0.5));
      len.Add(x[i].Length);
    }

    p = pts;
    l = len;
    min = Math.Round(len.Min(), 3);
    max = Math.Round(len.Max(), 3);
    A = RemapNumbers(Math.Round(len.Max(), 3), 0, y, 0, 1);
# ---------- c_script: C# additional code ----------
  public  double RemapNumbers(double speed = 50, double low1 = 0, double high1 = 2000, double low2 = 0, double high2 = 1) {
    return low2 + (speed - low1) * (high2 - low2) / (high1 - low1);
  }
# ---------- end c_script ----------
gradient = Gradient(
    LowerLimit=y,
    UpperLimit=c_script.min,
    Parameter=c_script.l,
    stops=[0: RGB(234, 38, 0), 0.5: RGB(254, 244, 84), 1: RGB(251, 255, 222)])
merge = Merge(Data1=flatten(c_script.min), Data2=flatten(y), Data3=flatten(c_script.max))
dots = DotDisplay(Point=c_script.p, Colour=gradient, Size=0.12)
multiplication = Multiplication()

mesh = Mesh(c_script.M)
demesh = DeconstructMesh(Mesh=mesh)  # -> Vertices, Faces, Colours, Normals
number_slider = Slider(600, range=0..600)
number_slider_2 = Slider(25, range=0..100)
lng = ListLength(List=demesh.Vertices)
range = Range(Domain=Domain(0, 1), Steps=expr("x-1", lng))
gradient_2 = Gradient(LowerLimit=0, UpperLimit=1, Parameter=range, stops=[0: RGB(234, 38, 0), 0.5: RGB(254, 244, 84), 1: RGB(251, 255, 222)])
number_slider_3 = Slider(13, range=0..100)
mcol = MeshColours(Mesh=mesh, Colours=gradient_2)
pt = ConstructPoint(XCoordinate=number_slider_2, YCoordinate=number_slider, ZCoordinate=0)

merge_2 = Merge(Data1="50", Data2=number_slider)  # -> flatten(Result)
num = Number(merge_2)
interp = InterpolateData(Data=num, Parameter=c_script.A, Interpolation=2)
merge_3 = Merge(Data1=merge_2, Data2=interp)  # -> flatten(Result)

pt_2 = ConstructPoint(XCoordinate=number_slider_2, YCoordinate=merge_3, ZCoordinate=0)

# ==== cluster Cluster
C = ClusterInput()
explode = Explode(Curve=C, Recursive=True)  # -> Segments, Vertices
curvepoint = PointOnCurve(explode.Segments, parameter=0.5)
points = PointList(Points=curvepoint, Size=Slider(0.318, range=0..100))
